# Grasshopper definition Urbanecanvas.gh (Grasshopper 1.0.7)
# plug-ins: Urbano, ShapeDiverForGrasshopper

sddp = ShapeDiverDocumentPayload({AbsoluteTolerance=0, AngleTolerance=0, DistanceDisplayPrecision=0, GltfVersion="Gltf2", GrasshopperVersion="1.0.0007", InputGroups="{}", OutputGroups="{}", RelativeTolerance=0, RhinoVersion="7.36.23346.16351", UnitSystem=0, VersionCreated="1.16.0.0", VersionSaved="1.16.0.0"})
panel = Panel("LONDON-ZONE 1")
path = FilePath("E:\IAAC\sem 2\data mgmt\map (6).osm")
swatch = ColourSwatch(SwatchColor=RGB(140, 227, 149))

location_point_z = Slider(3, range=0..10)
location_point_y = Slider(413, range=0..1000)
length_of_building = Slider(8, range=0..10)
width_of_building = Slider(8, range=0..10)
location_point_x = Slider(372, range=0..1000)
height_of_floor = Slider(2, range=0..10)
txt = Text("30")
utm = GetString(txt, AtLeast=1, AtMost=1, Prompt="UTM zone of the region", TreeAccess=False)
osm_file_path = GetFilePath(path, AtLeast=1, AtMost=1, TreeAccess=False)
length_of_building_2 = GetInteger(length_of_building, AtLeast=1, AtMost=1, Maximum=2147483647, Minimum=-2147483648, TreeAccess=False)
width_of_building_2 = GetInteger(width_of_building, AtLeast=1, AtMost=1, Maximum=2147483647, Minimum=-2147483648, TreeAccess=False)
heigth_of_floor = GetInteger(height_of_floor, AtLeast=1, AtMost=1, Maximum=2147483647, Minimum=-2147483648, TreeAccess=False)
location_point_z_2 = GetInteger(location_point_z, AtLeast=1, AtMost=1, Maximum=2147483647, Minimum=-2147483648, TreeAccess=False)
location_point_x_2 = GetInteger(location_point_x, AtLeast=1, AtMost=1, Maximum=2147483647, Minimum=-2147483648, TreeAccess=False)
location_point_y_2 = GetInteger(location_point_y, AtLeast=1, AtMost=1, Maximum=2147483647, Minimum=-2147483648, TreeAccess=False)
pt = ConstructPoint(XCoordinate=location_point_x_2, YCoordinate=location_point_y_2, ZCoordinate=location_point_z_2)
importosm = ImportOSMFeatures(OSMPathOrURL=osm_file_path, OSMFeatureType="building", Format="xml", UTMZone=utm, ImportAltitude=False)  # -> Points, Metadata, UTMZone, TranslationVector
importosm_2 = ImportOSMFeatures(OSMPathOrURL=osm_file_path, OSMFeatureType="power", Format="xml", UTMZone=utm, ImportAltitude=False)  # -> Points, Metadata, UTMZone, TranslationVector
importosm_3 = ImportOSMFeatures(OSMPathOrURL=osm_file_path, OSMFeatureType="sport", Format="xml", UTMZone=utm, ImportAltitude=False)  # -> Points, Metadata, UTMZone, TranslationVector
osmstreetnet = ImportOSMStreetNetwork(OSMPathOrURL=osm_file_path, UTMZone=utm)  # -> StreetNetwork, StreetSegmentCurves, UTMZone, TranslationVector
importosm_4 = ImportOSMFeatures(OSMPathOrURL=osm_file_path, OSMFeatureType="landuse", Format="xml", UTMZone=utm, ImportAltitude=False)  # -> Points, Metadata, UTMZone, TranslationVector
importosm_5 = ImportOSMFeatures(OSMPathOrURL=osm_file_path, OSMFeatureType="tourism", Format="xml", UTMZone=utm, ImportAltitude=False)  # -> Points, Metadata, UTMZone, TranslationVector
swatch_2 = ColourSwatch(SwatchColor=RGB(214, 115, 65))
rectangle = Rectangle(Plane=pt, XSize=length_of_building_2, YSize=width_of_building_2, Radius=0)  # -> Rectangle, Length
pline = PolyLine(Vertices=importosm_3.Points, Closed=False)
pline_2 = PolyLine(Vertices=importosm_5.Points, Closed=False)
pline_3 = PolyLine(Vertices=importosm_2.Points, Closed=False)
pline_4 = PolyLine(Vertices=importosm.Points, Closed=False)
pline_5 = PolyLine(Vertices=importosm_4.Points, Closed=False)
boxrec = BoxRectangle(Rectangle=rectangle.Rectangle, Height=Domain(0, 10))
streetnet = CreateStreetNetwork(
    StreetCurves=flatten(osmstreetnet.StreetSegmentCurves),
    Metadata=flatten(importosm.Metadata),
    SplitStreetCurves=True,
    UTMZone=importosm.UTMZone,
    TranslationVector=importosm.TranslationVector)  # -> StreetNetwork, StreetSegmentCurves, UTMZone, TranslationVector
bldg = CreateBuilding(BuildingCurve=pline_5, Metadata=importosm_4.Metadata)
bldg_2 = CreateBuilding(BuildingCurve=pline_4, Metadata=importosm.Metadata)
bldg_3 = CreateBuilding(BuildingCurve=pline_3, Metadata=importosm_2.Metadata)
brep = Brep(pline_5)
bldg_4 = CreateBuilding(BuildingCurve=pline_2, Metadata=importosm_5.Metadata)
bldg_5 = CreateBuilding(BuildingCurve=pline, Metadata=importosm_3.Metadata)
preview = CustomPreview(Geometry=boxrec, Material=swatch_2)  # disabled
road_thickness = Slider(10, range=0..10)
context_bake = ContextBake(ProposedBuilding=swatch_2)
swatch_3 = ColourSwatch(SwatchColor=RGB(18, 10, 0))
model = BuildUrbanoModel(Buildings=flatten(bldg_2), StreetNetwork=streetnet.StreetNetwork, BuildToggle=True)  # -> UrbanoModel, BuildingCurves, Activities
model_2 = BuildUrbanoModel(Buildings=flatten(bldg_3), StreetNetwork=streetnet.StreetNetwork, BuildToggle=True)  # -> UrbanoModel, BuildingCurves, Activities
model_3 = BuildUrbanoModel(Buildings=flatten(bldg_4), StreetNetwork=streetnet.StreetNetwork, BuildToggle=True)  # -> UrbanoModel, BuildingCurves, Activities
model_4 = BuildUrbanoModel(Buildings=flatten(bldg_5), StreetNetwork=streetnet.StreetNetwork, BuildToggle=True)  # -> UrbanoModel, BuildingCurves, Activities
preview_2 = CustomPreview(Geometry=brep, Material=swatch)  # disabled
contour = Contour(Shape=boxrec, Point=Point(0, 0, 0), Direction=Vector(0, 0, 1), Distance=heigth_of_floor)
context_bake_2 = ContextBake(Geometry=swatch)
area = Area(Geometry=flatten(contour))  # -> Area, Centroid
inbldg = InspectBuilding(Building=model_2.BuildingCurves, UrbanoModel=model_2.UrbanoModel, DefaultHeight=10)  # -> Geometry, Metadata, Amenity, BuildingMesh
inbldg_2 = InspectBuilding(Building=model.BuildingCurves, UrbanoModel=model.UrbanoModel, DefaultHeight=10)  # -> Geometry, Metadata, Amenity, BuildingMesh
inbldg_3 = InspectBuilding(Building=model_3.BuildingCurves, UrbanoModel=model_3.UrbanoModel, DefaultHeight=10)  # -> Geometry, Metadata, Amenity, BuildingMesh
preview_3 = CustomPreview(Geometry=streetnet.StreetSegmentCurves, Material=swatch_3)  # disabled
inbldg_4 = InspectBuilding(Building=model_4.BuildingCurves, UrbanoModel=model_4.UrbanoModel, DefaultHeight=10)  # -> Geometry, Metadata, Amenity, BuildingMesh
panel_2 = Panel(area.Centroid)
swatch_4 = ColourSwatch(SwatchColor=RGB(251, 247, 85))
context_bake_3 = ContextBake(RoadNetwork=swatch_3)
panel_3 = Panel(area.Area)
swatch_5 = ColourSwatch(SwatchColor=RGB(150, 147, 149))
swatch_6 = ColourSwatch(SwatchColor=RGB(27, 202, 52))
swatch_7 = ColourSwatch(SwatchColor=RGB(31, 53, 198))
ma = MassAddition(Input=flatten(area.Area))  # -> Result, PartialResults
preview_4 = CustomPreview(Geometry=inbldg_2.BuildingMesh, Material=swatch_4)  # disabled
preview_5 = CustomPreview(Geometry=inbldg.BuildingMesh, Material=swatch_5)  # disabled
panel_4 = Panel(ma.Result)
preview_6 = CustomPreview(Geometry=inbldg_3.BuildingMesh, Material=swatch_6)  # disabled
preview_7 = CustomPreview(Geometry=inbldg_4.BuildingMesh, Material=swatch_7)  # disabled
xy = XYPlane(Origin=pt)
context_bake_4 = ContextBake(UrbanContext=swatch_4)
context_bake_5 = ContextBake(PowerSupply=swatch_5)
Z = UnitZ(Factor="12")
concat = Concatenate(FragmentA=panel_4, FragmentB="m2")
context_bake_6 = ContextBake(Geometry=swatch_6)
move = Move(Geometry=xy, Motion=Z)  # -> Geometry, Transform
context_bake_7 = ContextBake(Geometry=swatch_7)
tag = TextTag(Location=move.Geometry, Text=concat)  # disabled
proposed_building = GetString("Proposed Building", AtLeast=1, AtMost=1, TreeAccess=False)
context_print = ContextPrint(AreaPerFloor=panel_3)
context_print_2 = ContextPrint(ProposedBuildingName=proposed_building)
context_print_3 = ContextPrint(TotalBuiltUpArea=panel_4)

context_print_4 = ContextPrint(Text=concat)
context_print_5 = ContextPrint(Text=area.Area)
context_print_6 = ContextPrint(Text=proposed_building)
context_print_7 = ContextPrint(Text=ma.Result)
