# Grasshopper definition lb-bfy-sync-data.gh (Grasshopper 1.0.7)

ny_laguardia = Panel("https://climate.onebuilding.org/WMO_Region_4_North_and_Central_America/USA_United_States_of_America/NY_New_York/USA_NY_New.York-LaGuardia.AP.725030_TMYx.zip")

toggle = BooleanToggle(False)  # disabled
epwmap = LBEPWmap(epw_map=toggle)  # -> report; disabled; plug-in component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

analysisperiod = LBAnalysisPeriod(
    start_month=Slider(6, range=1..12),
    start_day=Slider(16, range=1..30),
    start_hour=Slider(6, range=0..23),
    end_month=Slider(6, range=1..12),
    end_day=Slider(27, range=1..30),
    end_hour=Slider(18, range=0..23))  # -> period, hoys, dates; plug-in component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

downloadepw = LBDownloadWeather(weather_URL=ny_laguardia)  # -> epw_file, stat_file, ddy_file; plug-in component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
number_slider = Slider(98, range=1..360)
importepw = LBImportEPW(epw_file=downloadepw.epw_file)  # -> location, dry_bulb_temperature, dew_point_temperature, relative_humidity, wind_speed, wind_direction, direct_normal_rad, diffuse_horizontal_rad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; plug-in component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
sunpath = LBSunPath(north=number_slider, location=importepw.location, hoys=analysisperiod.hoys, scale=1)  # -> report, vectors, altitudes, azimuths, hoys, sun_pts, analemma, daily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; disabled; plug-in component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
compass = LBCompass(north=number_slider)  # -> compass; plug-in component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
srf = Surface(<surface referenced from the Rhino model>)
genpts = LBGeneratePointGrid(geometry=srf, grid_size=Slider(5, range=0..10))  # -> points, vectors, face_areas, mesh; plug-in component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
brep = Brep([<brep referenced from the Rhino model> x3])

# ---- group: wind-speed
applyper = LBApplyAnalysisPeriod(data=importepw.wind_speed, period=analysisperiod.period)  # -> data; plug-in component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

# ---- group: wind-direction
applyper_2 = LBApplyAnalysisPeriod(data=importepw.wind_direction, period=analysisperiod.period)  # -> data; plug-in component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

# ---- group: dry-bulb
applyper_3 = LBApplyAnalysisPeriod(data=importepw.dry_bulb_temperature, period=analysisperiod.period)  # -> data; plug-in component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

# ---- group: rela-humidity
applyper_4 = LBApplyAnalysisPeriod(data=importepw.relative_humidity, period=analysisperiod.period)  # -> data; plug-in component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

# ---- group: dire-normal-rad
applyper_5 = LBApplyAnalysisPeriod(data=importepw.direct_normal_rad, period=analysisperiod.period)  # -> data; plug-in component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

# ---- group: difuse-hori-rad
applyper_6 = LBApplyAnalysisPeriod(data=importepw.diffuse_horizontal_rad, period=analysisperiod.period)  # -> data; plug-in component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

# ---- group: hori-infra-rad
applyper_7 = LBApplyAnalysisPeriod(data=importepw.horizontal_infrared_rad, period=analysisperiod.period)  # -> data; plug-in component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

# ----
humantosky = LBHumanToSkyRelation(
    north=number_slider,
    location=importepw.location,
    position=flatten(genpts.points),
    context=flatten(brep),
    run=Toggle(True))  # -> report, human_points, human_line, fract_body_exp, sky_exposure; plug-in component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
applyper_8 = LBApplyAnalysisPeriod(data=humantosky.fract_body_exp, period=analysisperiod.period)  # -> data; plug-in component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
xdata = LBDeconstructData(data=applyper_8)  # -> header, values; plug-in component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
windrose = LBWindRose(north=number_slider, data=applyper, wind_direction=applyper_2)  # -> report, mesh, compass, orient_line, freq_line, windrose_line, legend, title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; plug-in component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
panel = Panel(xdata.values)
avr = Average(Input=xdata.values)  # -> flatten(ArithmeticMean)
outdoorsolarmrt = LBOutdoorSolarMRT(
    location=importepw.location,
    surface_temp=applyper_3,
    dir_norm_rad=applyper_5,
    diff_horiz_rad=applyper_6,
    horiz_infrared=applyper_7,
    fract_body_exp=avr,
    sky_exposure=humantosky.sky_exposure,
    run=Toggle(True))  # -> report, short_erf, long_erf, short_dmrt, long_dmrt, mrt; plug-in component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
utci = LBUTCIComfort(air_temp=applyper_3, mrt=outdoorsolarmrt.mrt, rel_humid=applyper_4, run=Toggle(True))  # -> report, utci, comfort, condition, category, comf_obj; plug-in component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
xdata_2 = LBDeconstructData(data=utci.utci)  # -> header, values; plug-in component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
avr_2 = Average(Input=xdata_2.values)  # -> flatten(ArithmeticMean)
panel_2 = Panel(xdata_2.header)
heatmap = LBSpatialHeatmap(values=avr_2, mesh=genpts.mesh)  # -> mesh, legend, title, colors, legend_par, vis_set; plug-in component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
panel_3 = Panel(avr_2)
