# Grasshopper definition osm-hobs.gh (Grasshopper 1.0.7)
# plug-ins: ShapeDiverForGrasshopper, Urbano, Nautilus, MeshEdit Components, treesloth01

sddp = ShapeDiverDocumentPayload({AbsoluteTolerance=0, AngleTolerance=0, DistanceDisplayPrecision=0, GltfVersion="Gltf2", GrasshopperVersion="1.0.0007", InputGroups="{}", OutputGroups="{}", RelativeTolerance=0, RhinoVersion="7.29.23107.3001", UnitSystem=0, VersionCreated="1.14.0.0", VersionSaved="1.14.0.0"})

# ----
# Left Bound = (-73.951184(w/e) - 0.01)
# Right Bound = (40.7128(n/s) + 0.01)
# Top Bound = (40.7128(n/s) + (0.01 / 1.5))
# Bottom Bound = (-73.951184(w/e) - (0.01 / 1.5))
# 
# Lon = Average(Top Bound and Bottom Bound)
# Lat = Average(Left Bound and Right Bound)
latitude = Panel("40.695294")
longitude = Panel("-73.959094")
latitude_2 = GetNumber("40.70962524573974", AtLeast=1, AtMost=1, Maximum=1.797693135e+308, Minimum=-1.797693135e+308, TreeAccess=False)
longitude_2 = GetNumber("-74.00834855408304", AtLeast=1, AtMost=1, Maximum=1.797693135e+308, Minimum=-1.797693135e+308, TreeAccess=False)
python = GhPythonScript(lat=latitude_2, lon=longitude_2)  # -> topBound, bottomBound, rightBound, leftBound
# ---------- python: Python ----------
import rhinoscriptsyntax as rs

leftBound = lon - 0.002
rightBound = lon + 0.002
topBound = lat + (0.002 / 1.5)
bottomBound = lat - (0.002 / 1.5)
# ---------- end python ----------

# ----
# Streets
download_openstreetmap_osm = DownloadOpenStreetMapOSM(
    LeftBound=python.leftBound,
    RightBound=python.rightBound,
    TopBound=python.topBound,
    BottomBound=python.bottomBound,
    RunToggle=True)  # -> OSMQueryURL, OSMFilePath
import_osm_features = ImportOSMFeatures(OSMPathOrURL=download_openstreetmap_osm.OSMQueryURL, OSMFeatureType="street", Format="xml", ImportAltitude=True)  # -> Points, Metadata, UTMZone, TranslationVector
project = Project(Geometry=import_osm_features.Points, Plane=PlaneXY(0, 0, 0))  # -> Geometry, Transform
polyline = PolyLine(Vertices=project.Geometry, Closed=False)
create_street_network = CreateStreetNetwork(
    StreetCurves=flatten(polyline),
    Metadata=flatten(import_osm_features.Metadata),
    SplitStreetCurves=False,
    UTMZone=import_osm_features.UTMZone,
    TranslationVector=import_osm_features.TranslationVector)  # -> StreetNetwork, StreetSegmentCurves, UTMZone, TranslationVector

# ----
# Terrain
download_dem_and_build_terrain_mesh = DownloadDEMAndBuildTerrainMesh(
    LeftBound=python.leftBound,
    RightBound=python.rightBound,
    TopBound=python.topBound,
    BottomBound=python.bottomBound,
    XCount=100,
    YCount=100)  # -> TerrainMesh, UTMZone, TranslationVector

# ---- group: Intention
txt = Text("text explaining bla")

# ----
# FacAid
panel = Panel(txt)

# ---- group: Build Basic Model
# Buildings
# Turn on build toggle
download_openstreetmap_osm_2 = DownloadOpenStreetMapOSM(
    LeftBound=python.leftBound,
    RightBound=python.rightBound,
    TopBound=python.topBound,
    BottomBound=python.bottomBound,
    RunToggle=True)  # -> OSMQueryURL, OSMFilePath
import_osm_features_2 = ImportOSMFeatures(OSMPathOrURL=download_openstreetmap_osm_2.OSMQueryURL, OSMFeatureType="amenity", Format="xml", ImportAltitude=True)  # -> Points, Metadata, UTMZone, TranslationVector
import_osm_features_3 = ImportOSMFeatures(OSMPathOrURL=download_openstreetmap_osm_2.OSMQueryURL, OSMFeatureType="building", Format="xml", ImportAltitude=True)  # -> Points, Metadata, UTMZone, TranslationVector
import_osm_features_4 = ImportOSMFeatures(OSMPathOrURL=download_openstreetmap_osm_2.OSMQueryURL, OSMFeatureType="street", Format="xml", ImportAltitude=True)  # -> Points, Metadata, UTMZone, TranslationVector
polyline_2 = PolyLine(Vertices=import_osm_features_4.Points, Closed=False)
create_amenity = CreateAmenity(PointLocationOfAmenity=import_osm_features_2.Points, Metadata=import_osm_features_2.Metadata)
polyline_3 = PolyLine(Vertices=import_osm_features_3.Points, Closed=False)
create_street_network_2 = CreateStreetNetwork(
    StreetCurves=flatten(polyline_2),
    Metadata=flatten(import_osm_features_4.Metadata),
    SplitStreetCurves=True,
    UTMZone=import_osm_features_4.UTMZone,
    TranslationVector=import_osm_features_4.TranslationVector)  # -> StreetNetwork, StreetSegmentCurves, UTMZone, TranslationVector
arrange_amenities_by_building = ArrangeAmenitiesByBuilding(Amenities=flatten(create_amenity), Buildings=flatten(polyline_3))  # -> AmenitiesByBuilding, Buildings
create_building = CreateBuilding(
    BuildingCurve=arrange_amenities_by_building.Buildings,
    Metadata=import_osm_features_3.Metadata,
    AmenitiesInBuilding=arrange_amenities_by_building.AmenitiesByBuilding)

# ----
project_2 = Project(Geometry=create_building, Plane=PlaneXY(0, 0, 0))  # -> Geometry, Transform

# ---- group: Build Basic Model (continued)
build_urbano_model = BuildUrbanoModel(Buildings=flatten(project_2.Geometry), StreetNetwork=create_street_network_2.StreetNetwork, BuildToggle=True)  # -> UrbanoModel, BuildingCurves, Activities
inspect_building = InspectBuilding(Building=project_2.Geometry, DefaultHeight=10)  # -> Geometry, Metadata, Amenity, BuildingMesh

# ----
bbox = BoundingBox(Content=download_dem_and_build_terrain_mesh.TerrainMesh, Plane=PlaneXY(0, 0, 0), UnionBox=True)  # -> Box, Box_2
wires = BrepWireframe(Brep=bbox.Box, Density=-1)
project_3 = Project(Geometry=wires, Plane=PlaneXY(0, 0, 0))  # -> Geometry, Transform
duplines = RemoveDuplicateLines(Lines=project_3.Geometry, Tolerance=0.01)
join = JoinCurves(Curves=duplines, Preserve=False)
Z = UnitZ(Factor="400")
extr = Extrude(Base=join, Direction=Z)
msplit = MeshSplit(Mesh=inspect_building.BuildingMesh, Splitters=extr)  # -> simplify(Result)
cap = CapHoles(Brep=extr)
explode = MeshExplode(Mesh=msplit, Interpolate=False)
facen = FaceNormals(Mesh=explode)  # -> Centers, Normals
renumber = RenumberPaths(Data=explode)
pshift = ShiftPaths(Data=facen.Centers, Offset=-1)
brepinc = PointInBrep(Brep=cap, Point=pshift, Strict=False)
txt_2 = Text(brepinc)
expression = Expression(x=txt_2, y="True", Expression="Contains(x,y)")  # -> simplify(R)
cull = CullPattern(List=renumber, CullPattern=expression)

context_bake = ContextBake(Buildings=cull)
context_bake_2 = ContextBake(Geometry=download_dem_and_build_terrain_mesh.TerrainMesh)
context_print = ContextPrint(README=txt)
context_bake_3 = ContextBake(Geometry=create_street_network.StreetSegmentCurves)
context_bake_4 = ContextBake(Geometry=build_urbano_model.BuildingCurves)
