# Grasshopper definition data_generation.gh (Grasshopper 1.0.7)
# plug-ins: MeshEdit Components, CORE.Toolbox.Grasshopper, Urbano, Stripper, ShapeDiverForGrasshopper, Human

sddp = ShapeDiverDocumentPayload({AbsoluteTolerance=0, AngleTolerance=0, DistanceDisplayPrecision=0, GltfVersion="Gltf2", GrasshopperVersion="1.0.0007", InputGroups="{}", OutputGroups="{}", RelativeTolerance=0, RhinoVersion="7.35.23346.11001", UnitSystem=0, VersionCreated="1.14.0.0", VersionSaved="1.14.0.0"})

# ---- group: Download OSM
download_openstreetmap_osm = DownloadOpenStreetMapOSM(LeftBound="54.36968", RightBound="54.37286", TopBound="24.47475", BottomBound="24.47308", RunToggle=True)  # -> OSMQueryURL, OSMFilePath

# ----
# 1. change location
# 
# GO TO OSM and get bounding box
panel = Panel("35.70168")
downloadosm = DownloadOpenStreetMapOSM(LeftBound="139.72945", RightBound="139.73079", TopBound="35.70336", BottomBound=panel, RunToggle=True)  # -> OSMQueryURL, OSMFilePath
panel_2 = Panel(downloadosm.OSMQueryURL)

# ---- group: Alternative Way to Import Network
# (Shortcut if you don't want to
# modify any street network data.
# Does not offer altitude info in the current version)
import_osm_street_network = ImportOSMStreetNetwork(OSMPathOrURL=downloadosm.OSMQueryURL)  # -> StreetNetwork, StreetSegmentCurves, UTMZone, TranslationVector
street_network = StreetNetwork(import_osm_street_network.StreetNetwork)

# ---- group: Import Geometries
# GET GOEMETRY FROM URBANO
import_osm_features = ImportOSMFeatures(OSMPathOrURL=downloadosm.OSMQueryURL, OSMFeatureType="amenity", Format="xml", ImportAltitude=False)  # -> Points, Metadata, UTMZone, TranslationVector
import_osm_features_2 = ImportOSMFeatures(OSMPathOrURL=downloadosm.OSMQueryURL, OSMFeatureType="building", Format="xml", ImportAltitude=False)  # -> Points, Metadata, UTMZone, TranslationVector
import_osm_features_3 = ImportOSMFeatures(OSMPathOrURL=downloadosm.OSMQueryURL, OSMFeatureType="street", Format="xml", ImportAltitude=False)  # -> Points, Metadata, UTMZone, TranslationVector

# ----
# 5. choose different
# test building
number_slider = Slider(641, range=0..1000)

# ----
# https://energyplus-weather.s3.amazonaws.com/asia_wmo_region_2/IRN/IRN_Yazd.408210_ITMY/IRN_Yazd.408210_ITMY.zip
# https://energyplus-weather.s3.amazonaws.com/europe_wmo_region_6/GBR/GBR_London.Gatwick.037760_IWEC/GBR_London.Gatwick.037760_IWEC.zip
# https://energyplus-weather.s3.amazonaws.com/europe_wmo_region_6/FRA/FRA_Clermont-Ferrand.074600_IWEC/FRA_Clermont-Ferrand.074600_IWEC.zip
# 2. change EPW
# https://energyplus-weather.s3.amazonaws.com/southwest_pacific_wmo_region_5/SGP/SGP_Singapore.486980_IWEC/SGP_Singapore.486980_IWEC.zip
# https://energyplus-weather.s3.amazonaws.com/europe_wmo_region_6/ITA/ITA_Torino.160590_IWEC/ITA_Torino.160590_IWEC.zip
# https://energyplus-weather.s3.amazonaws.com/europe_wmo_region_6/ESP/ESP_Madrid.082210_IWEC/ESP_Madrid.082210_IWEC.zip
panel_3 = Panel("https://energyplus-weather.s3.amazonaws.com/asia_wmo_region_2/JPN/JPN_Matsumoto.476180_IWEC/JPN_Matsumoto.476180_IWEC.zip")

# ----
# 1. Open EPWMap
# 1.1 zoom & select location
# 1.2 copy to clipboard
# https://energyplus-weather.s3.amazonaws.com/africa_wmo_region_1/EGY/EGY_Aswan.624140_IWEC/EGY_Aswan.624140_IWEC.zip
button = Button()
epwmap = LBEPWmap(epw_map=button)  # -> report; plug-in component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

# ----
# 2. Download EPW to default LB folder (C:\ladybug likely)
# https://energyplus-weather.s3.amazonaws.com/asia_wmo_region_2/ARE/ARE_Abu.Dhabi.412170_IWEC/ARE_Abu.Dhabi.412170_IWEC.zip
# 2.1 paste the EPW file address here
# https://energyplus-weather.s3.amazonaws.com/asia_wmo_region_2/SAU/SAU_Riyadh.404380_IWEC/SAU_Riyadh.404380_IWEC.zip
downloadepw = LBDownloadWeather(weather_URL=panel_3)  # -> epw_file, stat_file, ddy_file; plug-in component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

# ----
# 3. import EPW file
importepw = LBImportEPW(epw_file=downloadepw.epw_file)  # -> location, dry_bulb_temperature, dew_point_temperature, relative_humidity, wind_speed, wind_direction, direct_normal_rad, diffuse_horizontal_rad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; plug-in component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

# ----
# Download & import EPW file
# tip: some EPW files may be incomplete, try to find IWEC files which are tested
epwfilepath = FilePath(downloadepw.epw_file)

analysisperiod = LBAnalysisPeriod(start_month="1", start_day="7", start_hour=0, end_month="12", end_day="7", timestep="1")  # -> period, hoys, dates; plug-in component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

legendpar = LBLegendParameters()  # -> leg_par; plug-in component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
point = Point(Point(187.1174342, 109.7264556, 0))
sunpath = LBSunPath(location=importepw.location, hoys=analysisperiod.hoys, center_pt=point, scale=Slider(31, range=0..100))  # -> out, vectors, altitudes, azimuths, hoys, sun_pts, analemma, daily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; plug-in component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
# UTCI
skymatrix = LBCumulativeSkyMatrix(
    location=importepw.location,
    direct_rad=importepw.direct_normal_rad,
    diffuse_rad=importepw.diffuse_horizontal_rad,
    hoys=sunpath.hoys)  # -> out, sky_mtx; plug-in component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
# context
number_slider_2 = Slider(0.1, range=0..1)
toggle = BooleanToggle(True)
panel_4 = Panel(skymatrix.sky_mtx)

toggle_2 = BooleanToggle(True)
# 3. RUN LB Analysis
# 
# 
# THEN UNTOGGLE
button_2 = Button()

custom_mesh_settings = SettingsCustom(
    StitchSeams=True,
    SimplePlanes=False,
    Refine=True,
    MinCount=16,
    MaxCount=400,
    AspectRatio=20,
    MaxDistance=0,
    MaxAngle=20,
    MinEdge=0,
    MaxEdge=0)
# POINTS + VECTORS + VALUES PER MESH
# FILTERING VALUES
number_slider_3 = Slider(342, range=0..10000)

# ----
# 4. Export to CSV
# 
# THEN UNTOGGLE
boolean_toggle = BooleanToggle(True)

number_slider_4 = Slider(0, range=0..100)
number_slider_5 = Slider(1, range=0..1)

# ---- group: Build Basic Model
# Turn on build toggle
polyline = PolyLine(Vertices=import_osm_features_2.Points, Closed=False)
create_amenity = CreateAmenity(PointLocationOfAmenity=import_osm_features.Points, Metadata=import_osm_features.Metadata)
polyline_2 = PolyLine(Vertices=import_osm_features_3.Points, Closed=False)
create_street_network = CreateStreetNetwork(
    StreetCurves=flatten(polyline_2),
    Metadata=flatten(import_osm_features_3.Metadata),
    SplitStreetCurves=True,
    UTMZone=import_osm_features_3.UTMZone,
    TranslationVector=import_osm_features_3.TranslationVector)  # -> StreetNetwork, StreetSegmentCurves, UTMZone, TranslationVector
arrange_amenities_by_building = ArrangeAmenitiesByBuilding(Amenities=flatten(create_amenity), Buildings=flatten(polyline))  # -> AmenitiesByBuilding, Buildings
create_building = CreateBuilding(
    BuildingCurve=arrange_amenities_by_building.Buildings,
    Metadata=import_osm_features_2.Metadata,
    AmenitiesInBuilding=arrange_amenities_by_building.AmenitiesByBuilding)
build_urbano_model = BuildUrbanoModel(Buildings=flatten(create_building), StreetNetwork=create_street_network.StreetNetwork, BuildToggle=False)  # -> UrbanoModel, BuildingCurves, Activities

# ----
# randomize heights
number_slider_6 = Slider(26, range=20..30)
inspect_building = InspectBuilding(Building=create_building, DefaultHeight=10)  # -> Geometry, Metadata, Amenity, flatten(BuildingMesh)
dom = ConstructDomain(DomainStart=Slider(10, range=10..20), DomainEnd=number_slider_6)
lng = ListLength(List=inspect_building.BuildingMesh)
random = Random(Range=dom, Number=lng, Seed=2)  # -> simplify(graft(Random))

# ---- group: Build Basic Model (continued)
inspect_building_2 = InspectBuilding(Building=create_building, DefaultHeight=random)  # -> Geometry, Metadata, Amenity, flatten(BuildingMesh)

# ----
list_item = ListItem(List=inspect_building_2.BuildingMesh, Index=number_slider, Wrap=True)
# LB (SUN HOURS + RADIATION)
cull_i = CullIndex(List=inspect_building_2.BuildingMesh, Indices=number_slider, Wrap=True)
geo = Geometry(cull_i)
geo_2 = Geometry(list_item)
medges = MeshEdges(Mesh=geo)  # -> NakedEdges, InteriorEdges, NonManifoldEdges
previewlw = CustomPreviewLineweights(Geometry=medges.InteriorEdges, Shader=ColourSwatch(SwatchColor=RGBA(105, 105, 105, 146)), Absolute=False)
# building
bbox = BoundingBox(Content=geo_2, Plane=PlaneXY(0, 0, 0))  # -> Box, Box_2

deconstruct_brep = DeconstructBrep(Brep=bbox.Box)  # -> Faces, Edges, Vertices
list_item_2 = ListItem(List=deconstruct_brep.Faces, Index=Slider(4, range=0..10), Wrap=True)
area = Area(Geometry=list_item_2)  # -> Area, Centroid
rotate = Rotate(Geometry=bbox.Box, Angle=degrees(Slider(175, range=0..1000)), Plane=area.Centroid)  # -> Geometry, Transform

preview = CustomPreview(Geometry=geo, Material=ColourSwatch(SwatchColor=RGBA(255, 255, 255, 206)))
preview_2 = CustomPreview(Geometry=geo_2, Material=ColourSwatch(SwatchColor=RGBA(255, 255, 255, 126)))
directsunhours = LBDirectSunHours(
    vectors=flatten(sunpath.vectors),
    geometry=flatten(rotate.Geometry),
    context=flatten(geo),
    grid_size="1",
    offset_dist=number_slider_2,
    run=toggle_2)  # -> report, points, results, mesh, legend, title, int_mtx; plug-in component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
incidentradiation = LBIncidentRadiation(
    sky_mtx=skymatrix.sky_mtx,
    geometry=flatten(rotate.Geometry),
    context=flatten(geo),
    grid_size="1",
    offset_dist=number_slider_2,
    run=toggle_2)  # -> out, points, results, total, mesh, legend, title, int_mtx; plug-in component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
mesh = MeshBrep(
    Brep=rotate.Geometry,
    Settings={GridMaxCount=0, GridMinCount=16, JaggedSeams=False, MaxEdgeLength=0, MinEdgeLength=0.0001, MinTolerance=0, Refine=True, RefineAngle=0, RelativeTolerance=0.65, SimplePlanes=True, Tolerance=0})

number = Number(directsunhours.results)
construct_domain = ConstructDomain(DomainStart=number_slider_3, DomainEnd=Slider(1961, range=0..10000))
mesh_explode = MeshExplode(Mesh=directsunhours.mesh, Interpolate=False)
includes = Includes(Value=number, Domain=construct_domain)  # -> Includes, Deviation
dispatch = Dispatch(List=mesh_explode, DispatchPattern=includes.Includes)  # -> ListA, ListB
mesh_2 = Mesh(dispatch.ListB)

boolean = Boolean(includes.Includes)
dispatch_2 = Dispatch(List=incidentradiation.results, DispatchPattern=boolean)  # -> graft(ListA), ListB
dispatch_3 = Dispatch(List=incidentradiation.points, DispatchPattern=boolean)  # -> ListA, ListB
dispatch_4 = Dispatch(List=directsunhours.results, DispatchPattern=includes.Includes)  # -> graft(ListA), ListB
point_2 = Point(dispatch_3.ListA)
face_normals = FaceNormals(Mesh=mesh_2)  # -> Centers, Normals

# ----
# xyz coords
# normals
# sun hours
# radiation
panel_5 = Panel(dispatch_4.ListA)
panel_6 = Panel(dispatch_2.ListA)
panel_7 = Panel(face_normals.Normals)
panel_8 = Panel(face_normals.Centers)
merge = Merge(Data1="sun hours", Data2=panel_5)  # -> simplify(Result)
merge_2 = Merge(Data1="orientation", Data2=panel_7)  # -> simplify(Result)
merge_3 = Merge(Data1="radiation", Data2=panel_6)  # -> simplify(Result)
merge_4 = Merge(Data1="xyz coordinates", Data2=panel_8)  # -> simplify(Result)

# ----
# EXPORT
panel_9 = Panel("C:\Users\paude\Documents\00. Backup 2023\EXTERIOR\MASTER\MA IAAC\03. Cursada\01. Modulo 03\STUDIO\Studio_G02_Repo\AIA24-studio-AS-G02-fac_aid\src\GH_ladybug")
write_to_excel_classic = WriteToExcelClassic(
    WorkbookFilepath=panel_9,
    WorksheetName="radiation",
    Data=merge_4,
    LocationAddress="D1",
    Clear=Toggle(False),
    Stream=boolean_toggle)
panel_10 = Panel(write_to_excel_classic)

panel_11 = Panel("C:\Users\paude\Desktop\trial")
write_to_excel_classic_2 = WriteToExcelClassic(
    WorkbookFilepath=panel_9,
    WorksheetName="radiation",
    Data=merge_2,
    LocationAddress="C1",
    Clear=Toggle(False),
    Stream=boolean_toggle)
panel_12 = Panel(write_to_excel_classic_2)

write_to_excel_classic_3 = WriteToExcelClassic(
    WorkbookFilepath=panel_9,
    WorksheetName="radiation",
    Data=merge,
    LocationAddress="B1",
    Clear=Toggle(False),
    Stream=boolean_toggle)
panel_14 = Panel(write_to_excel_classic_3)

write_to_excel_classic_4 = WriteToExcelClassic(
    WorkbookFilepath=panel_9,
    WorksheetName="radiation",
    Data=merge_3,
    LocationAddress="A1",
    Clear=Toggle(False),
    Stream=boolean_toggle)
panel_16 = Panel(write_to_excel_classic_4)

concatenate = Concatenate(A=panel_8, B=panel_7, C=panel_5, D=panel_6)
panel_17 = Panel(concatenate)
mesh_3 = Mesh(mesh_2)
weave = Weave(G=mesh_3, T0=0.5, T1=0.333, D=1, Q=True)  # -> out, A; inputs G: GeometryBase, I: list, T0: list, T1: list, D: list, Q: list, clr: list of Color
# ---------- weave: VB ----------
    Component.Params.Input(0).Name = "Mesh or Curve"
    Component.Params.Input(0).Description = "Open or closed mesh or curve"
    Component.Params.Input(1).Name = "Index [Face]"
    Component.Params.Input(1).Description = "An optional integer or list of integers which specify the faces to be modified if the input is a mesh. If no value is supplied then all faces will be modified"
    Component.Params.Input(2).Name = "Edge Width [Vertex]"
    Component.Params.Input(2).Description = "Evaluated width of the new mesh face a the edge"
    Component.Params.Input(3).Name = "Face Width [Vertex]"
    Component.Params.Input(3).Description = "Evaluated width of the new mesh face at the center"
    Component.Params.Input(4).Name = "Distance [Vertex]"
    Component.Params.Input(4).Description = "An optional number or list of numbers for the offset value from the existing face"
    Component.Params.Input(5).Name = "Quads [Face]"
    Component.Params.Input(5).Description = "An optional boolean or list of boolean values which specifies if the new faces will be quads if true or triangles if false"
    Component.Params.Input(6).Name = "Colors [Vertex]"
    Component.Params.Input(6).Description = "(If applied to a mesh a list of colors corresponding to each mesh vertex, if applied to a curve, a list of colors corresponding to each control point plus an additonal color value for the new averaged center"

    Component.Params.Output(1).Name = "Mesh"
    Component.Params.Output(1).Description = "If successful, a valid mesh"

    If g IsNot Nothing Then
      Dim j,k,kk,n,t,v,w,cnt As Integer
      Dim u() As Integer = Nothing
      Dim tint() As Integer = Nothing
      Dim mo As New mesh
      Dim ov,cv As New list(Of Point3d)
      Dim ofc As New list(Of meshface)
      Dim oc,oca As New list(Of color)

      Dim blnM, blnC As Boolean

      Dim cen As point3d
      Dim vec As Vector3d
      Dim clrB As Boolean
      Dim avgClr,avgClrC As color

      blnM = g.ObjectType = ObjectType.Mesh
      blnC = g.ObjectType = ObjectType.Curve

      'Declare Mesh Variables
      Dim m As mesh
      Dim mf As Rhino.Geometry.Collections.MeshFaceList = Nothing
      Dim mv As Rhino.Geometry.Collections.MeshVertexList = Nothing
      Dim mtv As Rhino.Geometry.Collections.MeshTopologyVertexList = Nothing
      Dim mn As Rhino.Geometry.Collections.MeshFaceNormalList = Nothing
      Dim mc As Rhino.Geometry.Collections.MeshVertexColorList

      'Declare Curve Variables
      Dim crv As curve
      Dim ncrv As nurbsCurve
      Dim npts As rhino.Geometry.Collections.NurbsCurvePointList
      Dim vs() As vector3f

      If (blnM Or blnC) Then

        If blnM Then
          'Start Deconstruct if Mesh
          m = g
          m.Normals.ComputeNormals()
          m.FaceNormals.ComputeFaceNormals()
          mf = m.Faces
          mv = m.Vertices
          mtv = m.TopologyVertices
          mn = m.FaceNormals
          mc = m.VertexColors

          'Check Mesh Color Status
          If ((m.VertexColors.count() <> 0) Or (clr.count() <> 0)) Then clrB = True
          If ((m.VertexColors.count() = 0) And (clr.count() <> 0)) Then mc.CreateMonotoneMesh(color.LightGray)

          'Populate Vertex/ Color Lists
          oc = mc.ToArray().ToList()
        Else
          'Start Deconstruct if Curve
          crv = g
          ncrv = crv.ToNurbsCurve()
          npts = ncrv.Points
          Dim pline As Polyline = ncrv.Points.ControlPolygon
          Dim cmsh As New mesh
          cmsh.Vertices.AddVertices(pline.ToArray())
          cmsh.faces.addfaces(pline.TriangulateClosedPolyline())
          cmsh.Normals.ComputeNormals()
          cmsh.Normals.UnitizeNormals

          cv = pline.ToArray().ToList()
          If crv.IsClosed() Then cv.RemoveAt(pline.count() - 1)

          v = cv.Count() - 1
          If Not crv.IsClosed() Then v += 1
          u = appendprepend(v)
          w = -1
          vs = cmsh.Normals.ToArray()

          For j = 0 To v Step 1
            vec += vs(u(j))
            If (clr.count() > 0) Then If j > (clr.count() - 1) Then oc.add(clr.item(clr.count() - 1)) Else oc.add(clr.item(j))
          Next
          vec /= v
          vec.Unitize
          cen = pline.CenterPoint
        End If

        'Check clr input status
        If clr.count() <> 0 Then clrB = True

      End If

      If blnM Then If i.count() > 0 Then cnt = i.count() Else cnt = mf.count() Else cnt = 1
      For n = 0 To cnt - 1 Step 1
        If blnM Then
          If i.count() > 0 Then j = i.item(n) Else j = n

          tint = mf.GetTopologicalVertices(j)
          cen = mf.GetFaceCenter(j)
          vec = mn.item(j)

          If mf(j).isquad() Then v = 3 Else v = 2
          u = appendprepend(v)
          w = ov.count() - 1
        Else
          j = n
        End If
        vec.Unitize()

        t = 6

        Dim avgD As Double = 0

        If clrB Then
          Dim tt As Integer
          Dim aR,aG,aB,bR,bG,bB As New Double
          For k = 0 To v Step 1
            If blnM Then tt = mtv.MeshVertexIndices(tint(k))(0) Else tt = k
            aR += oc.item(tt).R
            aG += oc.item(tt).G
            aB += oc.item(tt).B
            If clr.count() > 0 Then
              If tt > (clr.count() - 1) Then tt = clr.count() - 1
              bR += clr.item(tt).R
              bG += clr.item(tt).G
              bB += clr.item(tt).B
            End If
          Next

          If (blnM Or ((clr.count() - 1) <= v)) Then avgClr = avgC(aR, aG, aB, v + 1) Else avgClr = clr.item(clr.count() - 1)
          If (blnM Or ((clr.count() - 1) <= v)) Then avgClrC = avgC(bR, bG, bB, v + 1) Else avgClrC = clr.item(clr.count() - 1)
        End If

        For k = 1 To v + 1  Step 1
          'Keep distance and t values from exceeding list lengths
          Dim p(2) As point3d
          Dim tv(2) As Integer
          Dim da(2),ta0(2),ta1(2),qa(2) As Double
          Dim tc(2) As color

          For kk = 0 To 2 Step 1
            If blnM Then
              tv(kk) = mtv.MeshVertexIndices(tint(u(k + kk - 1)))(0)
              p(kk) = New point3d(mv(tv(kk)))
            Else
              tv(kk) = u(k + kk - 1)
              p(kk) = New point3d(cv(tv(kk)))
            End If

            If tv(kk) > (d.count() - 1) Then da(kk) = d.item(d.count() - 1) Else da(kk) = d.item(tv(kk))
            If tv(kk) > (q.count() - 1) Then qa(kk) = q.item(q.count() - 1) Else qa(kk) = q.item(tv(kk))
            If tv(kk) > (t0.count() - 1) Then ta0(kk) = t0.item(t0.count() - 1) Else ta0(kk) = t0.item(tv(kk))
            If tv(kk) > (t1.count() - 1) Then ta1(kk) = t1.item(t1.count() - 1) Else ta1(kk) = t1.item(tv(kk))
            If clr.count() > 0 Then If tv(kk) > (clr.count() - 1) Then tc(kk) = clr.item(clr.count() - 1) Else tc(kk) = clr.item(tv(kk))

          Next

          'Define Vertices
          Dim pA(1),pB(1),pC As point3d
          Dim vA(1) As Vector3d

          pA(0) = (p(0) + p(1)) / 2
          pA(1) = (p(1) + p(2)) / 2
          pB(0) = (p(1) + pA(1)) / 2
          pB(1) = (p(2) + pA(1)) / 2

          pC = evalP(cen, pA(0), (ta1(0) + ta1(1)) / 2)

          ov.add(evalP(pB(0), p(1), ta0(1)))
          ov.add(evalP(pB(0), pA(1), ta0(1)))
          ov.add(evalP(pB(1), p(2), ta0(2)))
          ov.add(evalP(pB(1), pA(1), ta0(2)))
          ov.add(pC + New point3d(vec * ((da(0) + da(1)) / 2)))
          ov.add(pC + New point3d(vec * ((-da(0) - da(1)) / 2)))

          'Define Faces
          If qa(1) Then
            ofc.Add(New meshface(w + u(k) * t + 1, w + u(k) * t + 2, w + u(k + 1) * t + 5, w + u(k) * t + 5))
            ofc.Add(New meshface(w + u(k - 1) * t + 4, w + u(k - 1) * t + 3, w + u(k + 1) * t + 6, w + u(k) * t + 6))
          Else
            ofc.Add(New meshface(w + u(k) * t + 1, w + u(k) * t + 2, w + u(k + 1) * t + 5))
            ofc.Add(New meshface(w + u(k) * t + 1, w + u(k + 1) * t + 5, w + u(k) * t + 5))
            ofc.Add(New meshface(w + u(k - 1) * t + 4, w + u(k - 1) * t + 3, w + u(k + 1) * t + 6))
            ofc.Add(New meshface(w + u(k - 1) * t + 4, w + u(k + 1) * t + 6, w + u(k) * t + 6))
          End If
          If v > 3 Then
            ofc.Add(New meshface(w + u(k) * t + 5, w + u(k + 1) * t + 5, w + t * (v + 1) + 1))
            ofc.Add(New meshface(w + u(k) * t + 6, w + u(k + 1) * t + 6, w + t * (v + 1) + 2))
          End If
          avgD += da(0)
          'Define Vertex Colors
          If clrB Then
            Dim clB As Boolean = (blnC And ((clr.count() - 1) > v))
            Dim tclr(3) As color
            tclr(0) = evalC(oc.item(tv(1)), oc.item(tv(2)), 0.25)
            tclr(1) = evalC(oc.item(tv(1)), oc.item(tv(2)), 0.5)
            tclr(2) = evalC(oc.item(tv(1)), oc.item(tv(2)), 0.75)
            tclr(3) = evalC(oc.item(tv(0)), oc.item(tv(1)), 0.5)

            oca.add(evalC(tclr(0), oc.item(tv(1)), ta0(1)))
            oca.add(evalC(tclr(0), tclr(1), ta0(0)))

            oca.add(evalC(tclr(2), oc.item(tv(2)), ta0(2)))
            oca.add(evalC(tclr(2), tclr(1), ta0(1)))

            If clr.count() > 0 Then oca.add(avgClrC) Else oca.add(evalC(avgClr, tclr(3), (ta1(0) + ta1(1)) / 2))
            If clr.count() > 0 Then oca.add(avgClrC) Else oca.add(evalC(avgClr, tclr(3), (ta1(0) + ta1(1)) / 2))
          End If
        Next

        avgD /= (v + 1)
        If v = 2 Then
          ofc.Add(New meshface(w + 5, w + 11, w + 17))
          ofc.Add(New meshface(w + 12, w + 18, w + 6))
        ElseIf v = 3 Then
          ofc.Add(New meshface(w + 5, w + 11, w + 17, w + 23))
          ofc.Add(New meshface(w + 12, w + 18, w + 24, w + 6))
        ElseIf v > 3 Then
          ov.add(cen + vec * avgD)
          ov.add(cen + vec * -avgD)
          oca.add(avgclr)
          oca.add(avgclr)
        End If
      Next

      mo.Vertices.AddVertices(ov.toarray())
      If clrB Then mo.VertexColors.AppendColors(oca.toarray())
      mo.Faces.AddFaces(ofc.toarray())
      A = mo

    End If
# ---------- weave: VB additional code ----------
  Private Function appendprepend(ByVal i As Integer)
    Dim srsEnum As IEnumerable(Of Integer) = Enumerable.Range(0, i + 1)
    Dim arrVal As New list(Of Integer)
    arrVal = srsEnum.tolist()
    arrVal.add(0)
    arrVal.insert(0, i)
    Return arrVal.toarray()
  End Function

  Private Function evalP(ByVal op As point3d, ByVal tp As Point3d, ByVal t As Double)

    Return New point3d(op + (tp - op) * t)
  End Function

  Private Function evalC(ByVal oc As color, ByVal tc As color, ByVal t As Double)
    Dim r,g,b As Integer
    r = CInt(CInt(oc.R) + (CInt(tc.R) - CInt(oc.R)) * t)
    g = CInt(CInt(oc.G) + (CInt(tc.G) - CInt(oc.G)) * t)
    b = CInt(CInt(oc.B) + (CInt(tc.B) - CInt(oc.B)) * t)

    If r > 255 Then r = 255 Else If r < 0 Then r = 0
    If g > 255 Then g = 255 Else If g < 0 Then g = 0
    If b > 255 Then b = 255 Else If b < 0 Then b = 0

    Return color.FromArgb(r, g, b)
  End Function

  Private Function avgC(ByVal R As Double, ByVal G As Double, ByVal B As Double, ByVal T As Integer)

    R /= t
    G /= t
    B /= t
    If R > 255 Then R = 255 Else If R < 0 Then R = 0
    If G > 255 Then G = 255 Else If G < 0 Then G = 0
    If B > 255 Then B = 255 Else If B < 0 Then B = 0

    Return color.FromArgb(CInt(R), CInt(G), CInt(B))
  End Function
# ---------- end weave ----------
color_mesh_faces_randomly = ColorMeshFacesRandomly(
    Mesh=weave.A,
    RedInfluence=number_slider_4,
    RedInfluence_2=number_slider_5,
    GreenInfluence=5,
    GreenInfluence_2=250,
    BlueInfluence=number_slider_4,
    BlueInfluence_2=number_slider_5)
preview_3 = CustomPreview(Geometry=rotate.Geometry, Material=ColourSwatch(SwatchColor=RGB(255, 255, 255)))
