# Grasshopper definition ladybug.gh (Grasshopper 1.0.7)
# plug-ins: Weaverbird, Authenticate, CreateProject, WindSpeedAnalysis, LoadProject, SyncSnapshot, RunAnalyses, ReadAnalyses, CreatePOIs, BitmapPlus, SolarRadiationAnalysis, SunlightHoursAnalysis, CreateBuildings, CreateStreets, MetaHopper, ShapeDiverForGrasshopper, Human, Pufferfish, eleFront, MeshEdit Components, TT Toolbox, CORE.Toolbox.Grasshopper, treesloth01, Hops

panel = Panel("https://energyplus-weather.s3.amazonaws.com/north_and_central_america_wmo_region_4/USA/NY/USA_NY_New.York.City-Central.Park.744860_TMY2/USA_NY_New.York.City-Central.Park.744860_TMY2.zip")

# ---- group: London
# https://climate.onebuilding.org/WMO_Region_4_North_and_Central_America/USA_United_States_of_America/NY_New_York/USA_NY_New.York-Downtown.Manhattan.Heli.720553_TMYx.zip
panel_2 = Panel("40.7096")
panel_3 = Panel("-74.0083")

# ---- group: Hong Kong
# https://climate.onebuilding.org/WMO_Region_2_Asia/HKG_Hong_Kong/HKG_KOW_Hong.Kong.Obs.450050_TMYx.zip
panel_4 = Panel("22.3193")
panel_5 = Panel("114.1694")

# ---- group: NYC
# https://climate.onebuilding.org/WMO_Region_4_North_and_Central_America/USA_United_States_of_America/NY_New_York/USA_NY_New.York-LaGuardia.AP.725030_TMY3.zip
panel_6 = Panel("40.7096")
panel_7 = Panel("-74.0083")

# ----
# https://github.com/iaac-macad/AIA24-studio-AS-G02-fac_aid/blob/main/src/gh-scripts/andres/osm-hobs.gh
panel_8 = Panel("C:\Users\ARoncal\source\repos\AIA24-studio-AS-G02-fac_aid\src\gh-scripts\andres\osm-hobs.gh")
hops = Hops(
    _Path=panel_8,
    Latitude=panel_6,
    Longitude=panel_7,
    CacheResultsInMemory=True,
    CacheSolveResults=True,
    RemoteDefinitionLocation="C:\Users\ARoncal\source\repos\AIA24-studio-AS-G02-fac_aid\src\gh-scripts\andres\osm-hobs.gh",
    RemoteSolveVersion=(0, 1, 0),
    ShowInput_Enabled=False,
    ShowInput_Path=True,
    SynchronousSolve=True)  # -> README, Streets, Lot, Terrain, Buildings
clean = CleanTree(RemoveNulls=True, RemoveInvalid=True, RemoveEmpty=True, Tree=hops.Buildings)
wbjoin = WeaverbirdsJoinMeshesAndWeld(Mesh=clean, Weld=True)
pt = ConstructPoint(XCoordinate=0, YCoordinate=0, ZCoordinate=0)
Z = UnitZ(Factor=Slider(10, range=0..10))
wbjoin_2 = WeaverbirdsJoinMeshesAndWeld(Mesh=hops.Terrain, Weld=True)
arrlinear = LinearArray(Geometry=pt, Direction=Z, Count=10)  # -> Geometry, Transform
clsmsh = CloseMesh(Mesh=wbjoin, Quadrangulate=True)  # -> Closed, Amount, Openings, R
item = ListItem(List=flatten(clsmsh.Closed), Index=Slider(301, range=0..423), Wrap=True)

# ---- group: SiteLot
crv = Curve(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)

# ----
# Building
panel_9 = Panel("""2
3
4
5
6""")
lng = ListLength(List=panel_9)
python = GhPythonScript(listLength=lng, floorHeight="3")  # -> newHeights; inputs listLength: Int32, floorHeight: Int32
# ---------- python: Python ----------
__author__ = "WNash"
__version__ = "2023.11.23"

import rhinoscriptsyntax as rs

heightOut = floorHeight
newHeights = []

for num in range(listLength):
    newHeights.append(heightOut)
    heightOut += floorHeight
# ---------- end python ----------
offset = OffsetCurve(Curve=crv, Distance=expr("-x", panel_9), Corners=1)  # -> flatten(Curve)
Z_2 = UnitZ(Factor=Slider(19, range=0..100))
Z_3 = UnitZ(Factor="3")
Z_4 = UnitZ(Factor=python)
move = Move(Geometry=offset, Motion=Z_2)  # -> Geometry, Transform
move_2 = Move(Geometry=move.Geometry, Motion=Z_4)  # -> Geometry, Transform
extr = Extrude(Base=move_2.Geometry, Direction=Z_3)
cap = CapHoles(Brep=extr)

pln = Plane(arrlinear.Geometry)
sec = MeshPlane(Mesh=item, Plane=pln)
volume = MeshVolume(Mesh=clsmsh.Closed)  # -> Volume, Centroid
Z_5 = UnitZ(Factor=1)
volume_2 = MeshVolume(Mesh=item)  # -> Volume, Centroid
extr_2 = Extrude(Base=sec, Direction=Z_5)
move_3 = Move(Geometry=sec, Motion=Z_5)  # -> Geometry, Transform
offset_2 = OffsetCurve(Curve=move_3.Geometry, Distance=-1, Corners=1)

# ---- group: Shades
offset_3 = OffsetCurve(Curve=move_2.Geometry, Distance=Slider(3.52, range=1..4), Corners=1)
boundary = BoundarySurfaces(Edges=offset_3)  # -> flatten(Surfaces)

# ----
cap_2 = CapHoles(Brep=extr_2)
volume_3 = Volume(Geometry=flatten(cap_2))  # -> Volume, Centroid
join = JoinCurves(Curves=move_3.Geometry, Preserve=False)  # -> simplify(Curves)
join_2 = JoinCurves(Curves=offset_2, Preserve=False)  # -> simplify(Curves)
pdecon = Deconstruct(Point=volume_3.Centroid)  # -> XComponent, YComponent, ZComponent
Z_6 = UnitZ(Factor=Slider(9, range=0..10))
loft = Loft(Curves=[join_2, join], Options={Adjust=False, Closed=False, LoftEnds=0, LoftSimp=0, LoftType=0, Rebuild=10, Refit=0.01})

# ---- group: Building Ground
item_2 = ListItem(List=move_2.Geometry, Index=0, Wrap=True)
offset_4 = OffsetCurve(Curve=item_2, Distance="3", Corners=1)  # -> flatten(Curve)
Z_7 = UnitZ(Factor="0.2")
extr_3 = Extrude(Base=offset_4, Direction=expr("-x", Z_7))
cap_3 = CapHoles(Brep=extr_3)

# ----
int = Integer(pdecon.ZComponent)
extr_4 = Extrude(Base=join_2, Direction=Z_6)
extr_5 = Extrude(Base=loft, Direction=Z_6)
bnd = Bounds(Numbers=int)
cap_4 = CapHoles(Brep=extr_4)
dedomain = DeconstructDomain(Domain=bnd)  # -> Start, End
equals = Equality(FirstNumber=int, SecondNumber=dedomain.Start)  # -> Equality, Inequality
cull = CullPattern(List=flatten(cap_2), CullPattern=equals.Equality)
downloadepw = LBDownloadWeather(weather_URL=panel)  # -> epw_file, stat_file, ddy_file; plug-in component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

epw_filepath = Data(panel)  # disabled
srf = Surface(move_2.Geometry)  # disabled

# ----
# Part 2.1 - UTCI with ground materials
toggle = GroupToggle(ToggleActive=True, ToggleVisible=False)  # disabled
roomsolid = HBRoomFromSolid(geo=flatten(cull), conditioned=True)  # -> report, rooms; disabled; plug-in component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
panel_10 = Panel("Concrete Pavement")  # disabled
ground = HBGround(rooms=roomsolid.rooms, soil_constr=panel_10)  # -> rooms; disabled; plug-in component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
model = HBModel(rooms=flatten(ground))  # -> report, model; disabled; plug-in component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
number_slider = Slider(3.6, range=0..10)  # disabled
genpts = LBGeneratePointGrid(geometry=srf, grid_size=number_slider)  # -> points, vectors, face_areas, mesh; disabled; plug-in component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
points = Data(genpts.points)  # disabled
sensorgrid = HBSensorGrid(positions=points)  # -> grid; disabled; plug-in component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
assigngridsviews = HBAssignGridsAndViews(model=model.model, grids=flatten(sensorgrid))  # -> model; disabled; plug-in component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
number_slider_2 = Slider(7, range=1..12)  # disabled
number_slider_3 = Slider(2, range=1..31)  # disabled
number_slider_4 = Slider(12, range=0..23)  # disabled
number_slider_5 = Slider(13, range=0..23)  # disabled
epw_filepath_2 = Data(epw_filepath)  # disabled
downloadepw_2 = LBDownloadWeather(weather_URL=epw_filepath_2)  # -> epw_file, stat_file, ddy_file; disabled; plug-in component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
toggle_2 = BooleanToggle(True)  # disabled
analysisperiod = LBAnalysisPeriod(
    start_month=number_slider_2,
    start_day=number_slider_3,
    start_hour=number_slider_4,
    end_month=number_slider_2,
    end_day=number_slider_3,
    end_hour=number_slider_5)  # -> period, hoys, dates; disabled; plug-in component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
utcimap = HBUTCIComfortMap(
    model=assigngridsviews,
    epw=downloadepw_2.epw_file,
    ddy=downloadepw_2.ddy_file,
    run_period=analysisperiod.period,
    run=toggle_2)  # -> report, env_conds, utci, condition, category, TCP, HSP, CSP; disabled; plug-in component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
toggle_3 = BooleanToggle(True)  # disabled
thermalmtx = HBReadThermalMatrix(comf_result=utcimap.utci, load=toggle_3)  # -> comf_mtx; disabled; plug-in component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
xmatrix = LBDeconstructMatrix(matrix=flatten(thermalmtx))  # -> values; disabled; plug-in component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
number_slider_6 = Slider(158, range=0..1000)  # disabled
xdata = LBDeconstructData(data=xmatrix)  # -> header, values; disabled; plug-in component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
points_2 = Data(points)  # disabled
number_slider_7 = Slider(4, range=0..100)  # disabled
avr = Average(Input=xdata.values)  # -> flatten(ArithmeticMean); disabled
item_3 = ListItem(List=xmatrix, Index=number_slider_6, Wrap=True)  # disabled
item_4 = ListItem(List=points_2, Index=number_slider_6, Wrap=True)  # disabled
panel_11 = Panel("1")  # disabled
python_2 = GhPythonScript(nums=avr, digits=panel_11)  # -> out, nums_rounded; inputs nums: list, digits: Int32; disabled
# ---------- python_2: Python ----------
__author__ = "Ekaterina Vititneva"
__version__ = "2023.10.17"

import rhinoscriptsyntax as rs

nums_rounded = [round(x, digits) for x in nums]
# ---------- end python_2 ----------
pt_2 = Point(Point(86.96126392, -19.53288665, 0))  # disabled

qrmesh = QuadRemesh(Mesh=cap_4, Settings={aqc=True, as=50, dhe=True, gci=0, null=False, pme=0, sa=0, tqc=2000})
panel_12 = Panel(qrmesh)
volume_4 = MeshVolume(Mesh=qrmesh)  # -> Volume, flatten(Centroid)
avr_2 = Average(Input=volume_4.Centroid)
cps = ClosestPoints(Point=avr_2, Cloud=flatten(volume.Centroid), Count=Slider(11, range=0..100))  # -> ClosestPoint, CPIndex, Distance
cull_i = CullIndex(List=flatten(clsmsh.Closed), Indices=cps.CPIndex, Wrap=True)
explode = MeshExplode(Mesh=qrmesh, Interpolate=False)  # -> simplify(Faces)

# ---- group: Canopy Geo.
preview = CustomPreview(Geometry=clsmsh.Closed, Material=ColourSwatch(SwatchColor=RGBA(99, 88, 88, 236)))

# ----
area = Area(Geometry=crv)  # -> Area, Centroid; disabled
colrange = LBColorRange(index=Slider(18, range=0..26))  # -> colors; plug-in component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
legendpar = LBLegendParameters(min="0", max="10", colors=colrange, continuous_leg=Toggle(False), num_decimals="0", vert_or_horiz=Toggle(False))  # -> leg_par; plug-in component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

# ---- group: BuilingContext
brep = Brep(Tree({1}: [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], {2}: [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], {3}: [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], {8}: [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], {9}: [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], {10}: [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]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))  # disabled

# ----
mesh = Mesh()  # disabled
move2pt = MoveToPoint(Geometry=mesh, PointB=area.Centroid)  # -> Moved, Vector, Transform; disabled
number_slider_8 = Slider(0.721, range=0..1)  # disabled

# ---- group: Contour
move2pt_2 = MoveToPoint(PointB=area.Centroid)  # -> Moved, Vector, Transform; disabled
swatch = ColourSwatch(SwatchColor=RGB(120, 120, 120))  # disabled
preview_2 = CustomPreview(Geometry=move2pt_2.Moved, Material=swatch)  # disabled

# ---- group: Topo
move2pt_3 = MoveToPoint(PointB=area.Centroid)  # -> Moved, Vector, Transform; disabled

# ----
sddp = ShapeDiverDocumentPayload({AbsoluteTolerance=0, AngleTolerance=0, DistanceDisplayPrecision=0, GltfVersion="Gltf2", GrasshopperVersion="1.0.0007", InputGroups="{}", OutputGroups="{}", RelativeTolerance=0, RhinoVersion="7.29.23107.3001", UnitSystem=0, VersionCreated="1.14.0.0", VersionSaved="1.14.0.0"})
number_slider_9 = Slider(20, range=0..100)
toggle_4 = GroupToggle(ToggleActive=True, ToggleVisible=False)  # disabled
pt_3 = ConstructPoint(XCoordinate=0, YCoordinate=0, ZCoordinate=0)
rectangle = Rectangle(Plane=pt_3, XSize=number_slider_9, YSize=number_slider_9, Radius=0)  # -> Rectangle, Length
importepw = LBImportEPW(epw_file=downloadepw.epw_file)  # -> location, dry_bulb_temperature, dew_point_temperature, relative_humidity, wind_speed, wind_direction, direct_normal_rad, diffuse_horizontal_rad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; plug-in component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
psychrometricchart = LBPsychrometricChart(temperature=importepw.dew_point_temperature, rel_humidity=importepw.relative_humidity)  # -> report, title, temp_lines, rh_lines, hr_lines, enth_wb_lines, mesh, legend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; plug-in component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
previewlw = CustomPreviewLineweights(
    Geometry=[psychrometricchart.mesh, psychrometricchart.legend, psychrometricchart.rh_lines, psychrometricchart.hr_lines, psychrometricchart.temp_lines, psychrometricchart.title, psychrometricchart.enth_wb_lines],
    Shader={diffuse=RGB(255, 105, 180), emission=RGB(76, 32, 54), shine=0.5, specular=RGB(255, 255, 255), transparency=0},
    Absolute=False)
analysisperiod_2 = LBAnalysisPeriod(
    start_month=Slider(1, range=1..12),
    start_day=1,
    start_hour=Slider(7, range=1..24),
    end_month=Slider(12, range=1..12),
    end_hour=Slider(20, range=1..24))  # -> period, hoys, dates; plug-in component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
panel_13 = Panel("5")
panel_14 = Panel("30")
legendpar_2 = LBLegendParameters()  # -> leg_par; plug-in component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
number_slider_10 = Slider(2, range=-1..3)
skymatrix = LBCumulativeSkyMatrix(
    location=importepw.location,
    direct_rad=importepw.direct_normal_rad,
    diffuse_rad=importepw.diffuse_horizontal_rad,
    hoys=analysisperiod_2.hoys)  # -> report, sky_mtx; plug-in component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
number_slider_11 = Slider(0, range=0..100)  # disabled
number_slider_12 = Slider(0.634, range=0..10)  # disabled
number_slider_13 = Slider(0.586, range=0..10)  # disabled
number_slider_14 = Slider(2.585, range=0..10)  # disabled
number_slider_15 = Slider(5282, range=0..8760)
expression = Expression(x=number_slider_10, Expression="x*2")
move_4 = Move(Geometry=area.Centroid, Motion="{0,0,100}")  # -> Geometry, Transform
skydome = LBSkyDome(sky_mtx=skymatrix.sky_mtx, center_pt=volume_2.Centroid, scale=Slider(0.324, range=0..1))  # -> report, mesh, compass, legend, title, patch_vecs, patch_values, mesh_values, vis_set; disabled; plug-in component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
hourlyplot = LBHourlyPlot(
    data=flatten(importepw.dry_bulb_temperature),
    base_pt=volume_2.Centroid,
    x_dim=number_slider_12,
    y_dim=number_slider_14,
    z_dim=number_slider_11,
    legend_par=legendpar_2,
    period=analysisperiod_2.period)  # -> report, mesh, legend, borders, labels, title; disabled; plug-in component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
incidentradiation = LBIncidentRadiation(
    sky_mtx=skymatrix.sky_mtx,
    geometry=explode,
    context=flatten(clsmsh.Closed),
    grid_size=number_slider_10,
    offset_dist=expression,
    legend_par=legendpar_2,
    run=Toggle(True))  # -> report, points, results, total, mesh, legend, title, int_mtx; plug-in component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
project = ProjectPoint(Point=move_4.Geometry, Direction=Vector(0, 0, -1), Geometry=move2pt_3.Moved)  # -> Point, Index
radrose = LBRadiationRose(
    sky_mtx=skymatrix.sky_mtx,
    context=flatten(cull_i),
    center_pt=volume_2.Centroid,
    scale="0.002",
    arrow_scale=0.6,
    legend_par=legendpar_2)  # -> report, mesh, compass, orient_lines, legend, title, dir_vecs, dir_values, vis_set; plug-in component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
sunpath = LBSunPath(location=importepw.location, hoys=analysisperiod_2.hoys, center_pt=avr_2, scale="0.002", daily=Slider(1, range=0..1))  # -> report, vectors, altitudes, azimuths, hoys, sun_pts, analemma, daily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; plug-in component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
move_5 = Move(Geometry=project.Point, Motion="{0,0,5}")  # -> Geometry, Transform
previewlw_2 = CustomPreviewLineweights(
    Geometry=[radrose.mesh, radrose.compass, radrose.orient_lines, radrose.legend, radrose.title, radrose.dir_vecs],
    Shader={diffuse=RGB(255, 105, 180), emission=RGB(76, 32, 54), shine=0.5, specular=RGB(255, 255, 255), transparency=0},
    Absolute=False)
dots = DotDisplay(Point=sunpath.sun_pts, Colour=ColourSwatch(SwatchColor=RGB(245, 211, 20)), Size=Slider(0.295, range=0..1))
previewlw_3 = CustomPreviewLineweights(Geometry=[sunpath.compass, sunpath.legend, sunpath.title], Shader=ColourSwatch(SwatchColor=RGB(0, 0, 0)), Absolute=False)
solarenvelope = LBSolarEnvelope()  # -> report, points, mesh; disabled; plug-in component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
rtrad = LBRealTimeIncidentRadiation()  # -> results; disabled; plug-in component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
xmatrix_2 = LBDeconstructMatrix(matrix=flatten(incidentradiation.int_mtx))  # -> simplify(values); disabled; plug-in component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

rectangle_2 = Rectangle(Plane=move_5.Geometry, XSize="-5 To 6", YSize="-5 To 6", Radius=0)  # -> Rectangle, Length
rotate = Rotate(Geometry=rectangle_2.Rectangle, Angle=degrees(Slider(17, range=0..1000)), Plane=move_5.Geometry)  # -> Geometry, Transform
Z_8 = UnitZ(Factor=Slider(15, range=0..100))
extr_6 = Extrude(Base=rotate.Geometry, Direction=Z_8)
cap_5 = CapHoles(Brep=extr_6)

directsunhours = LBDirectSunHours(
    vectors=flatten(sunpath.vectors),
    geometry=explode,
    context=flatten(cull_i),
    grid_size=number_slider_10,
    offset_dist=expression,
    legend_par=legendpar_2,
    run=Toggle(True))  # -> report, points, results, mesh, legend, title, int_mtx; plug-in component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

mesh_2 = Mesh(simplify(incidentradiation.mesh))
medges = MeshEdges(Mesh=mesh_2)  # -> NakedEdges, InteriorEdges, NonManifoldEdges
explode_2 = MeshExplode(Mesh=mesh_2, Interpolate=False)  # -> simplify(Faces)
demesh = DeconstructMesh(Mesh=explode_2)  # -> simplify(Vertices), Faces, simplify(Colours), Normals
cset = CreateSet(List=demesh.Colours)  # -> Set, Map
mesh_3 = Mesh(simplify(directsunhours.mesh))
explode_3 = MeshExplode(Mesh=mesh_3, Interpolate=False)  # -> simplify(Faces)
shift = ShiftPaths(Data=cset.Set, Offset=-1)
demesh_2 = DeconstructMesh(Mesh=explode_3)  # -> simplify(Vertices), Faces, simplify(Colours), Normals
cset_2 = CreateSet(List=demesh_2.Colours)  # -> Set, Map
shift_2 = ShiftPaths(Data=cset_2.Set, Offset=-1)
stack = StackTrees(Data0=shift, Data1=shift_2, Reduce=True)
merge = Merge(Data1=shift, Data2=shift_2)
tstat = TreeStatistics(Tree=stack)  # -> Paths, Length, Count
series = Series(Start=0, Step=1, Count=tstat.Count)

# ---- group: Buildings
swatch_2 = ColourSwatch(SwatchColor=RGB(201, 201, 201))  # disabled
preview_3 = CustomPreview(Shader=swatch_2)  # disabled

# ---- group: Roads
swatch_3 = ColourSwatch(SwatchColor=RGB(59, 59, 59))  # disabled
preview_4 = CustomPreview(Material=swatch_3)  # disabled

# ---- group: Tittle
pt_4 = Point(Point(-204507.7498, -225689.6778, 13.32498069))  # disabled
scale = Scale(Center=pt_4, Factor=0.5)  # -> Geometry, Transform; disabled
move2pt_4 = MoveToPoint(Geometry=scale.Geometry, PointB=area.Centroid)  # -> Moved, Vector, Transform; disabled
preview_5 = CustomPreview(Geometry=move2pt_4.Moved, Material=swatch_3)  # disabled

# ---- group: Legend
move2pt_5 = MoveToPoint(PointB=area.Centroid)  # -> Moved, Vector, Transform; disabled
mesh_4 = Mesh(move2pt_5.Moved)  # disabled

# ----
panel_15 = Panel(incidentradiation.results)
previewmat = CustomPreviewMaterials(Geometry=cull, DiffuseColor=swatch_2, Transparency=number_slider_8)  # disabled
preview_6 = CustomPreview(Geometry=move2pt_3.Moved, Material=swatch)  # disabled
filter = StreamFilter(Gate=Toggle(True), Stream1=directsunhours.int_mtx)
flip = FlipMatrix(Data=xmatrix_2)
panel_16 = Panel(radrose.title)
panel_17 = Panel(incidentradiation.title)
panel_18 = Panel(directsunhours.title)
tstat_2 = TreeStatistics(Tree=xmatrix_2)  # -> Paths, Length, Count
item_5 = ListItem(List=flatten(sunpath.title), Index=0, Wrap=True)
item_6 = ListItem(List=flatten(incidentradiation.title), Index=0, Wrap=True)
item_7 = ListItem(List=flatten(directsunhours.title), Index=0, Wrap=True)
item_8 = ListItem(List=flatten(radrose.title), Index=0, Wrap=True)
series_2 = Series(Start=0, Step=1, Count=tstat_2.Count)

# ---- group: Write to Excel Room Data from Revit
column_start = Slider(2, range=1..40)
row_start = Slider(2, range=1..40)
wo = WriteOptions(
    ClearDataOverwrite=True,
    SaveAfterWrite=Toggle(True),
    CloseAfterWrite=Toggle(False),
    ColumnStartPosition=column_start,
    RowStartPosition=row_start)  # -> UserMessages, WriteOptions; disabled
toggle_5 = BooleanToggle(True)
writexl = WriteToExcel(
    Run=toggle_5,
    ExcelWorksheet="Sheet1",
    ColumnNames=series_2,
    WriteOptions=wo.WriteOptions,
    ColumnnsOrRows=Toggle(True),
    DataToWriteIntoColumns=xmatrix_2)  # disabled

# ----
panel_19 = Panel("C:\Users\ARoncal\source\repos\AIA24-studio-AS-G02-fac_aid\src\data\brooklyn\brooklyn-wind-solar.xlsx")
facen = FaceNormals(Mesh=explode_2)  # -> Centers, Normals
stack_2 = StackTrees(
    Data0=flatten(incidentradiation.results),
    Data1=flatten(directsunhours.results),
    Data2=flatten(sunpath.azimuths),
    Data3=flatten(radrose.dir_values),
    Reduce=True)
stack_3 = StackTrees(Data0=item_6, Data1=item_7, Data2=item_5, Data3=item_8, Reduce=True)  # -> flatten(Tree)

panel_20 = Panel("C:\Users\ARoncal\source\repos\AIA24-studio-AS-G02-fac_aid\src\gh-scripts\andres\nyc-wind-solar.xlsx")
wo_2 = WriteOptions(
    FilePath=panel_20,
    ClearDataOverwrite=True,
    SaveAfterWrite=Toggle(True),
    CloseAfterWrite=False,
    ColumnStartPosition=1,
    RowStartPosition=1)  # -> UserMessages, WriteOptions
writexl_2 = WriteToExcel(
    Run=Toggle(False),
    ExcelWorksheet="1",
    ColumnNames=stack_3,
    WriteOptions=wo_2.WriteOptions,
    ColumnnsOrRows=Toggle(False),
    DataToWriteIntoColumns=stack_2)

panel_21 = Panel(xmatrix_2)
panel_22 = Panel(series)
xl_out = WriteToExcelClassic(Data=flip, LocationAddress="A1", Clear=0, Stream=toggle_5)  # disabled
panel_23 = Panel(facen.Centers)

# ----
# ImportEpw
panel_24 = Panel("https://climate.onebuilding.org/WMO_Region_4_North_and_Central_America/USA_United_States_of_America/NY_New_York/USA_NY_New.York-Downtown.Manhattan.Heli.720553_TMYx.zip")  # disabled
toggle_6 = BooleanToggle(False)  # disabled
downloadepw_3 = LBDownloadWeather(weather_URL=panel_24)  # -> epw_file, stat_file, ddy_file; disabled; plug-in component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
epwmap = LBEPWmap(epw_map=toggle_6)  # -> report; disabled; plug-in component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

constructiontypes = HBConstructionTypes({"SteelFramed", "WoodFramed", "Mass", "Metal Building"}, selected="SteelFramed")  # disabled
bldgprograms = HBBuildingPrograms({"LargeOffice", "MediumOffice", "SmallOffice", "MidriseApartment", "HighriseApartment", "Retail", "StripMall", "PrimarySchool", "SecondarySchool", "SmallHotel", "LargeHotel", "Hospital", "Outpatient", "Laboratory", "Warehouse", "SuperMarket", "FullServiceRestaurant", "QuickServiceRestaurant", "Courthouse", "LargeDataCenterHighITE", "LargeDataCenterLowITE", "SmallDataCenterHighITE", "SmallDataCenterLowITE"}, selected="MidriseApartment")  # disabled
panel_25 = Panel("Rooms")  # disabled
toggle_7 = GroupToggle(ToggleActive=True, ToggleVisible=False)  # disabled
toggle_8 = BooleanToggle(True)  # disabled
material = CreateMaterial(Diffuse=RGB(255, 105, 180), Specular=RGB(255, 255, 255), Emission=RGB(0, 0, 0), Transparency=0, Shine=0)  # disabled
reflay = ReferenceByLayer(LayerName=panel_25, lightweight=False)  # disabled
searchprog = HBSearchPrograms(bldg_prog=bldgprograms)  # -> room_prog; disabled; plug-in component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
searchconstrset = HBSearchConstructionSets(keywords=constructiontypes)  # -> constr_sets; disabled; plug-in component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
toggle_9 = BooleanToggle(True)  # disabled
preview_7 = CustomPreview(Geometry=reflay, Material=material)  # disabled
list = ItemSelector(
    searchconstrset,
    {"1980_2004::ClimateZone1::SteelFramed", "1980_2004::ClimateZone2::SteelFramed", "1980_2004::ClimateZone3::SteelFramed", "1980_2004::ClimateZone4::SteelFramed", "1980_2004::ClimateZone5::SteelFramed", "1980_2004::ClimateZone6::SteelFramed", "1980_2004::ClimateZone7::SteelFramed", "1980_2004::ClimateZone8::SteelFramed", "2004::ClimateZone1::SteelFramed", "2004::ClimateZone2::SteelFramed"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}, selected="2019::ClimateZone5::SteelFramed")  # disabled
list_2 = ItemSelector(
    searchprog,
    {"2019::MidriseApartment::Apartment", "2019::MidriseApartment::Corridor", "2019::MidriseApartment::Office"}, selected="2019::MidriseApartment::Apartment")  # disabled
intsolid = HBIntersectSolids(solids=flatten(cap_4), run=toggle_8)  # -> int_solids; disabled; plug-in component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
panel_26 = Panel("Housing")  # disabled
roomsolid_2 = HBRoomFromSolid(geo=flatten(intsolid), name=panel_26, constr_set=list, program=list_2, conditioned=toggle_9)  # -> report, rooms; disabled; plug-in component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

sddp_2 = ShapeDiverDocumentPayload({AbsoluteTolerance=0, AngleTolerance=0, DistanceDisplayPrecision=0, GltfVersion="Gltf2", GrasshopperVersion="1.0.0007", InputGroups="{}", OutputGroups="{}", RelativeTolerance=0, RhinoVersion="7.29.23107.3001", UnitSystem=0, VersionCreated="1.14.0.0", VersionSaved="1.14.0.0"})  # disabled
toggle_10 = BooleanToggle(True)  # disabled
solveadj = HBSolveAdjacency(rooms=flatten(roomsolid_2.rooms), run=toggle_10)  # -> report, adj_rooms; disabled; plug-in component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
number_slider_16 = Slider(0.286, range=0..1)  # disabled
number_slider_17 = Slider(0.362, range=0..1)  # disabled
number_slider_18 = Slider(0.195, range=0..1)  # disabled
number_slider_19 = Slider(0.315, range=0..1)  # disabled
facparam = HBFacadeParameters(north=number_slider_18, east=number_slider_19, south=number_slider_16, west=number_slider_17)  # -> fac_par; disabled; plug-in component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
aperturesbyratio = HBAperturesByRatio(hb_objs=flatten(solveadj.adj_rooms), ratio=facparam)  # -> report, hb_objs; disabled; plug-in component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
toggle_11 = BooleanToggle(True)  # disabled
vizbytype = HBVisualizeByType(hb_objs=aperturesbyratio.hb_objs)  # -> walls, interior_walls, roofs, ceilings, exterior_floors, interior_floors, air_walls, apertures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; disabled; plug-in component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
labelrooms = HBLabelRooms(rooms_model=flatten(aperturesbyratio.hb_objs))  # -> label_text, base_pts, labels, wire_frame; disabled; plug-in component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
lablefaces = HBLabelFaces(hb_objs=flatten(aperturesbyratio.hb_objs), sub_faces=toggle_11)  # -> label_text, base_pts, labels, wire_frame; disabled; plug-in component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
preview_8 = CustomPreview(
    Geometry=vizbytype.interior_floors,
    Material={diffuse=RGB(221, 160, 221), emission=RGB(66, 48, 66), shine=0.5, specular=RGB(255, 255, 255), transparency=0})  # disabled
preview_9 = CustomPreview(
    Geometry=vizbytype.apertures,
    Material={diffuse=RGB(221, 160, 221), emission=RGB(66, 48, 66), shine=0.5, specular=RGB(255, 255, 255), transparency=0})  # disabled
preview_10 = CustomPreview(
    Geometry=vizbytype.walls,
    Material={diffuse=RGB(221, 160, 221), emission=RGB(66, 48, 66), shine=0.5, specular=RGB(255, 255, 255), transparency=0})  # disabled
data = Data(vizbytype.apertures)  # disabled
explode_4 = MeshExplode(Mesh=vizbytype.walls, Interpolate=False)  # disabled
area_2 = MeshArea(Mesh=explode_4)  # -> Area, Centroid; disabled

# ---- group: Additional preview for model exloration
meshselector = LBMeshThresholdSelector(values=python_2.nums_rounded, mesh=genpts.mesh)  # -> report, total_value, total_area, sub_mesh, outline; disabled; plug-in component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
hourlyplot_2 = LBHourlyPlot(data=item_3, base_pt=pt_2, y_dim=number_slider_7)  # -> report, mesh, legend, borders, labels, title, vis_set; plug-in component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
tag = TextTag3D(Location=points_2, Text=python_2.nums_rounded, Size=1, Colour=ColourSwatch(SwatchColor=RGB(0, 0, 0)), Justification=7)
toggle_12 = GroupToggle(ToggleActive=True, ToggleVisible=False)  # disabled

# ---- group: Main preview
vizthermalmap = HBVisualizeThermalMap(comf_mtx=thermalmtx, mesh=flatten(genpts.mesh))  # -> report, mesh, legend, title, colors, values; plug-in component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
toggle_13 = GroupToggle(ToggleActive=True, ToggleVisible=False)  # disabled

# ----
runannualloads = BooleanToggle(True)  # disabled
runannualloads_2 = BooleanToggle(True)  # disabled
annualloads = HBAnnualLoads(rooms=flatten(aperturesbyratio.hb_objs), epw_file=downloadepw_3.epw_file, run=runannualloads)  # -> report, total_load, cooling, heating, lighting, equip, process, hot_water, balance; disabled; plug-in component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
annualloads_2 = HBAnnualLoads(rooms=flatten(roomsolid_2.rooms), epw_file=downloadepw_3.epw_file, run=runannualloads_2)  # -> report, total_load, cooling, heating, lighting, equip, process, hot_water, balance; disabled; plug-in component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
optimizedvalues = Panel(annualloads.total_load)  # disabled
basevalues = Panel(annualloads_2.total_load)  # disabled

# ---- group: Context Buildings
move2pt_6 = MoveToPoint(PointB=area.Centroid)  # -> flatten(Moved), Vector, Transform

# ---- group: Topo
msh2psrf = MeshToPolysurface(Mesh=move2pt_3.Moved, Triangles=False, FaceMerge=False)

# ----
geo = Geometry(cull)
floor = Curve(move_2.Geometry)

# ---- group: Opening#
lng_2 = ListLength(List=lablefaces.label_text)

# ----
area_3 = Area(Geometry=geo)  # -> Area, Centroid

siteandbuilding = Relay([cap_4, geo])
siteandcontext = Relay([geo, move2pt_6.Moved])

wires = BrepWireframe(Brep=siteandcontext, Density=-1)

# ----
# preview
wires_2 = BrepWireframe(Brep=lablefaces.wire_frame, Density=-1)
wires_3 = BrepWireframe(Brep=cap_4, Density=-1)
wires_4 = BrepWireframe(Brep=cap_4, Density=-1)
preview_11 = CustomPreview(Geometry=move2pt_6.Moved, Material=ColourSwatch(SwatchColor=RGB(128, 128, 128)))
preview_12 = CustomPreview(Geometry=boundary, Material=ColourSwatch(SwatchColor=RGB(0, 255, 98)))
preview_13 = CustomPreview(Geometry=boundary, Material=ColourSwatch(SwatchColor=RGB(196, 196, 196)))  # disabled
preview_14 = CustomPreview(Geometry=wires_2, Material=ColourSwatch(SwatchColor=RGB(112, 112, 112)))
preview_15 = CustomPreview(Geometry=wires_4, Material=ColourSwatch(SwatchColor=RGBA(0, 0, 0, 69)))

# ----
# Import Location from EPW File
downloadepw_4 = LBDownloadWeather(weather_URL=panel)  # -> epw_file, stat_file, ddy_file; disabled; plug-in component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
importepw_2 = LBImportEPW(epw_file=downloadepw_4.epw_file)  # -> location, dry_bulb_temperature, dew_point_temperature, relative_humidity, wind_speed, wind_direction, direct_normal_rad, diffuse_horizontal_rad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; disabled; plug-in component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

accountforlocalshading = BooleanToggle(True)  # disabled
list_3 = ValueList({"simulate Massing + site": 0, "simulate only Massing": 1, "simulate only windows": 2}, selected="simulate only windows")  # disabled

# ----
# Analysis Period for
# Summer Solstice
panel_27 = Panel("6")  # disabled
panel_28 = Panel("21")  # disabled
panel_29 = Panel("9")  # disabled
panel_30 = Panel("1")  # disabled
analysisperiod_3 = LBAnalysisPeriod(start_month=panel_27, start_day=panel_28, start_hour=0, end_month=panel_29, end_day=panel_28, timestep=panel_30)  # -> period, hoys, dates; disabled; plug-in component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

# ----
# Analysis Period for
# Feb 21
panel_31 = Panel("21")  # disabled
panel_32 = Panel("2")  # disabled
panel_33 = Panel("2")  # disabled
panel_34 = Panel("1")  # disabled
analysisperiod_4 = LBAnalysisPeriod(start_month=panel_32, start_day=panel_31, start_hour=0, end_month=panel_33, end_day=panel_31, timestep=panel_34)  # -> period, hoys, dates; disabled; plug-in component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

# ---- group: Context!
brep_2 = Brep(boundary)  # disabled
shade = HBShade(geo=brep_2)  # -> report, shades; disabled; plug-in component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

# ----
# Create Sky Matrix
panel_35 = Panel("20")  # disabled
skymatrix_2 = LBCumulativeSkyMatrix(
    north=panel_35,
    location=importepw_2.location,
    direct_rad=importepw_2.direct_normal_rad,
    diffuse_rad=importepw_2.diffuse_horizontal_rad,
    hoys=analysisperiod_3.hoys)  # -> report, sky_mtx; disabled; plug-in component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
skydome_2 = LBSkyDome(sky_mtx=skymatrix_2.sky_mtx)  # -> report, mesh, compass, legend, title, patch_vecs, patch_values, mesh_values, vis_set; disabled; plug-in component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

# ---- group: Run Me!
toggle_14 = BooleanToggle(True)  # disabled

# ----
sunion = SolidUnion()

# ---- group: note: lower left corner MUST be in 0,0,0
size = Slider(500, range=0..1000)  # disabled
panel_36 = Panel("0")  # disabled
pt_5 = ConstructPoint(XCoordinate=panel_36, YCoordinate=panel_36, ZCoordinate=panel_36)  # disabled
rectangle_3 = Rectangle(Plane=pt_5, XSize=size, YSize=size, Radius=0)  # -> Rectangle, Length; disabled

# ----
area_4 = Area(Geometry=rectangle_3.Rectangle)  # -> Area, Centroid

data_2 = Data([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])  # disabled
data_3 = Data(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)  # disabled
data_4 = Data([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])  # disabled

swatch_4 = ColourSwatch(SwatchColor=RGB(0, 0, 0))  # disabled
swatch_5 = ColourSwatch(SwatchColor=RGB(212, 135, 135))  # disabled
swatch_6 = ColourSwatch(SwatchColor=RGB(232, 232, 232))  # disabled

street_lines = Geometry([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])  # disabled
buildings = Geometry([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])  # disabled
poi = Geometry([Point(178.7483735, 391.5904497, 0), Point(142.1590494, 104.9740774, 0), Point(404.3825389, 141.5634016, 0)])  # disabled

# ----
# Geometry Preparation
# Only works for Rectangular massings for this simplified example
toggle_15 = GroupToggle(ToggleActive=True, ToggleVisible=False)  # disabled
panel_37 = Panel("0")  # disabled
filter_2 = StreamFilter(Gate=list_3, Stream0=siteandbuilding, Stream1=cap_4, Stream2=lablefaces.wire_frame)  # disabled
filter_3 = StreamFilter(Gate=accountforlocalshading, Stream0=move2pt_6.Moved, Stream1=[boundary, move2pt_6.Moved])  # disabled
analysis_resolution = Panel("3")  # disabled
panel_38 = Panel("0.01")  # disabled
boundary_2 = BoundarySurfaces(Edges=floor)  # disabled
panel_39 = Panel("0,0,3")  # disabled
mesh_5 = Mesh(lablefaces.wire_frame)  # disabled
mesh_6 = Mesh(filter_2)  # disabled
mesh_7 = Mesh(filter_3)  # disabled
extr_7 = Extrude(Base=boundary_2, Direction=panel_39)  # disabled
clean_2 = CleanTree(RemoveNulls=True, RemoveInvalid=True, RemoveEmpty=False, Tree=mesh_6)  # disabled
clean_3 = CleanTree(RemoveNulls=True, RemoveInvalid=True, RemoveEmpty=False, Tree=mesh_7)  # disabled
panel_40 = Panel("0.1")  # disabled
panel_41 = Panel("0.2")  # disabled
panel_42 = Panel("0.3")  # disabled
toggle_16 = BooleanToggle(True)  # disabled
panel_43 = Panel("1")  # disabled
recipesettings = HBRecipeSettings(reload_old=toggle_16)  # -> settings; disabled; plug-in component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
pt_6 = Point(Point(0, 0, 0))  # disabled
toggle_17 = BooleanToggle(False)  # disabled
panel_44 = Panel("2")  # disabled
panel_45 = Panel("2")  # disabled
galapagos = Galapagos()
number_slider_20 = Slider(0, range=0..100)  # disabled
number_slider_21 = Slider(12, range=0..100)  # disabled
importepw_3 = LBImportEPW(epw_file=downloadepw.epw_file)  # -> location, dry_bulb_temperature, dew_point_temperature, relative_humidity, wind_speed, wind_direction, direct_normal_rad, diffuse_horizontal_rad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; disabled; plug-in component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
analysisperiod_5 = LBAnalysisPeriod(start_month=number_slider_20, start_day=1, start_hour=0, end_month=number_slider_21)  # -> period, hoys, dates; disabled; plug-in component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
toggle_18 = BooleanToggle(False)  # disabled
windrose = LBWindRose(
    data=importepw_3.wind_speed,
    wind_direction=importepw_3.wind_direction,
    show_avg=toggle_18,
    period=analysisperiod_5.period)  # -> report, mesh, compass, orient_line, freq_line, windrose_line, legend, title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; disabled; plug-in component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
swatch_7 = ColourSwatch(SwatchColor=RGB(0, 0, 0))  # disabled
previewlw_4 = CustomPreviewLineweights(
    Geometry=[windrose.compass, windrose.orient_line, windrose.freq_line, windrose.legend, windrose.title, windrose.mesh],
    Shader=swatch_7,
    Absolute=False)  # disabled

# ---- group: Opaque Faces
geo_2 = Geometry(extr_7)  # disabled
panel_46 = Panel("TestRoom")  # disabled
roomsolid_3 = HBRoomFromSolid(geo=flatten(geo_2), name=panel_46, conditioned=True)  # -> report, rooms; disabled; plug-in component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

# ---- group: Apertures
panel_47 = Panel("g_material")  # disabled
panel_48 = Panel("0.55")  # disabled
glassmod = HBGlassModifier(name=panel_47, trans=panel_48)  # -> modifier; disabled; plug-in component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
aperture = HBAperture(geo=mesh_5, rad_mod=glassmod)  # -> report, apertures; disabled; plug-in component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
addsubface = HBAddSubface(hb_obj=flatten(roomsolid_3.rooms), sub_faces=flatten(aperture.apertures))  # -> hb_obj; disabled; plug-in component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
panel_49 = Panel("0.3")  # disabled
bordershades = HBExtrudedBorderShades(hb_objs=flatten(addsubface), depth=panel_49)  # -> report, hb_objs; disabled; plug-in component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

# ----
# Model
# + Grids
panel_50 = Panel("sample_model_grid")  # disabled
panel_51 = Panel("2")  # disabled
model_2 = HBModel(rooms=flatten(bordershades.hb_objs), shades=flatten(shade.shades), name=panel_50)  # -> report, model; disabled; plug-in component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
gridrooms = HBSensorGridFromRooms(rooms=bordershades.hb_objs, grid_size=panel_51, dist_floor=panel_42)  # -> grid, points, mesh; disabled; plug-in component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
vizwiref = HBVisualizeWireframe(hb_objs=flatten(model_2.model))  # -> geo; disabled; plug-in component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
assigngridsviews_2 = HBAssignGridsAndViews(model=model_2.model, grids=flatten(gridrooms.grid))  # -> model; disabled; plug-in component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

# ---- group: Sun Path
bbox = BoundingBox(Content=clean_2, Plane=PlaneXY(0, 0, 0), UnionBox=True)  # -> Box, Box_2; disabled
panel_52 = Panel("8")  # disabled
volume_5 = Volume(Geometry=bbox.Box)  # -> Volume, Centroid; disabled
sunpath_2 = LBSunPath(location=importepw_2.location, hoys=analysisperiod_4.hoys, center_pt=volume_5.Centroid, scale=panel_52)  # -> report, vectors, altitudes, azimuths, hoys, sun_pts, analemma, daily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; disabled; plug-in component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

# ----
# Run Recipe
daylightfactor = HBDaylightFactor(model=assigngridsviews_2, run_settings=recipesettings, run=toggle_17)  # -> report, results; disabled; plug-in component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

# ----
# Incident Radiation
incidentradiation_2 = LBIncidentRadiation(
    sky_mtx=skymatrix_2.sky_mtx,
    geometry=flatten(clean_2),
    context=flatten(clean_3),
    grid_size=panel_41,
    offset_dist=panel_40,
    run=toggle_14)  # -> report, points, results, total, mesh, legend, title, int_mtx; disabled; plug-in component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
mesh_8 = Mesh(incidentradiation_2.mesh)  # disabled

# ---- group: Sun Hours
panel_53 = Panel("0.1")  # disabled
directsunhours_2 = LBDirectSunHours(
    vectors=flatten(sunpath_2.vectors),
    geometry=flatten(clean_2),
    context=flatten(clean_3),
    grid_size=panel_41,
    offset_dist=panel_40,
    run=toggle_14)  # -> report, points, results, mesh, legend, title, int_mtx; disabled; plug-in component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

# ----
item_9 = ListItem(List=geo_2, Index=0, Wrap=True)  # disabled
skyview = HBSkyView(model=assigngridsviews_2, run_settings=recipesettings, run=toggle_17)  # -> report, results; disabled; plug-in component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
pt_7 = Point(directsunhours_2.points)  # disabled
avr_3 = Average(Input=flatten(skyview.results))  # disabled
smaller = SmallerThan(FirstNumber=directsunhours_2.results, SecondNumber=panel_44)  # -> SmallerThan, OrEqualTo; disabled
lng_3 = ListLength(List=directsunhours_2.results)  # disabled
tag_2 = TextTag(Location=pt_7, Text=directsunhours_2.results)  # disabled
ma = MassAddition(Input=smaller.SmallerThan)  # -> Result, PartialResults; disabled
division = Division(A=ma.Result, B=lng_3)  # disabled
roundd = RoundToDecimalPlace(NumberX=avr_3, DecimalPlace=panel_45, RoundType=0)  # -> Rounded, Difference; disabled
of_low_sun_hours = Panel(division)  # disabled
mjoin = MeshJoin(Meshes=flatten([lablefaces.wire_frame, gridrooms.mesh, brep_2]))  # disabled
entwine = Entwine(Branch00=mjoin, Branch01=of_low_sun_hours, Branch02=roundd.Rounded, FlattenInputs=True)  # disabled

# ----
# Visualize
# Results
mjoin_2 = MeshJoin(Meshes=gridrooms.mesh)  # disabled
data_5 = Data(flatten(skyview.results))  # disabled
panel_54 = Panel("%")  # disabled

heatmap = LBSpatialHeatmap(values=data_5, mesh=mjoin_2, legend_title=panel_54)  # -> mesh, legend, title, colors, legend_par, vis_set; disabled; plug-in component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

# ----
# Store and visualise design variants
rec = DataRecorder(entwine, DataLimit=-10, RecordData=True)  # disabled
bang = ExplodeTree(Data=rec)  # -> Branch0, Branch1, Branch2; disabled
panel_55 = Panel(rec)  # disabled
number_slider_22 = Slider(0, range=0..10)  # disabled
concat = Concatenate(FragmentA=bang.Branch1, FragmentB=bang.Branch2, JoinSeparator=",")  # disabled
item_10 = ListItem(List=bang.Branch0, Index=number_slider_22, Wrap=True)  # disabled
item_11 = ListItem(List=bang.Branch2, Index=number_slider_22, Wrap=True)  # disabled
item_12 = ListItem(List=bang.Branch1, Index=number_slider_22, Wrap=True)  # disabled
medges_2 = MeshEdges(Mesh=item_10)  # -> NakedEdges, InteriorEdges, NonManifoldEdges; disabled
csv_for_design_explorer = Panel(concat)  # disabled
panel_56 = Panel("white")  # disabled
panel_57 = Panel(item_11)  # disabled
panel_58 = Panel(item_12)  # disabled
preview_16 = CustomPreview(Geometry=item_10, Material=panel_56)  # disabled
panel_59 = Panel("Radiation")  # disabled
panel_60 = Panel("black")  # disabled
previewlw_5 = CustomPreviewLineweights(Geometry=[medges_2.NakedEdges, medges_2.InteriorEdges, medges_2.NonManifoldEdges], Shader=panel_60, Absolute=False)  # disabled
panel_61 = Panel("Sky")  # disabled
tracker = ValueTracker(
    panel_58,
    TrackerAutoDomain=True,
    TrackerColour=RGB(255, 155, 0),
    TrackerPeriod=10,
    TrackerUpdate=25,
    TrackerDomain=[0, 1])  # disabled
pt_8 = Point(Point(-52.44883845, -115.2988338, 0))  # disabled
pt_9 = Point(Point(-44.22276903, -114.2553921, 0))  # disabled

c_round_to_second_decimal = CSharpScript(x=panel_58)  # -> out, A; inputs x: Double; disabled
# ---------- c_round_to_second_decimal: C# ----------
    A = Math.Round(x, 2);
# ---------- end c_round_to_second_decimal ----------
c_round_to_second_decimal_2 = CSharpScript(x=panel_57)  # -> out, A; inputs x: Double; disabled; same code as c_round_to_second_decimal

concat_2 = Concatenate(FragmentA=panel_59, FragmentB=c_round_to_second_decimal.A, JoinSeparator=": ")  # disabled
concat_3 = Concatenate(FragmentA=panel_61, FragmentB=c_round_to_second_decimal_2.A, JoinSeparator=": ")  # disabled
tag_3 = TextTag(Location=pt_9, Text=concat_3)  # disabled
tag_4 = TextTag(Location=pt_8, Text=concat_2)  # disabled

# ----
# Login
# Project Settings
# Load Project and create Snapshots
# important: 1. Deactivate component
# 2. prepare all projects settings&analysis settings
# 3. activate component
# 4. deactivate component
# _______
# after a project is created this component should be deactivated. Project settings cannot be changed after afterwards. For different settings a new project with a new name needs to be created.
# Rhino/GH
# Geometry
# note: Once a project is created, simulation settings can not be changed anymore. The logic behind this restriction is to ensure comparability of all snapshots/ design variants that are created within a project.
# https://energyplus-weather.s3.amazonaws.com/south_america_wmo_region_3/PER/PER_Lima.846280_IWEC/PER_Lima.846280_IWEC.zip
panel_62 = Panel("-250 To 250")  # disabled
toggle_19 = GroupToggle(ToggleActive=True, ToggleVisible=False)  # disabled
project_name = Panel("testPrj_9999AR_5")  # disabled
project_description = Panel("testProject-v1.5")  # disabled
panel_63 = Panel(panel_6)  # disabled
panel_64 = Panel(panel_7)  # disabled
debrep = DeconstructBrep(Brep=data_2)  # -> flatten(Faces), Edges, Vertices; disabled
pt_10 = Point(Point(101.4162513, -22.40490456, 0))  # disabled
password = Panel("cXjna56LVgqr")  # disabled
username = Panel("iaac-macad-s1")  # disabled
debrep_2 = DeconstructBrep(Brep=data_4)  # -> Faces, Edges, Vertices; disabled
panel_65 = Panel("Secret -->")  # disabled
area_5 = Area(Geometry=debrep.Faces)  # -> Area, Centroid; disabled
area_6 = Area(Geometry=debrep_2.Faces)  # -> Area, Centroid; disabled
ir_auth = InFraReDAuthenticate(Username=username, Password=password)  # disabled
toggle_20 = BooleanToggle(False)  # disabled
pdecon_2 = Deconstruct(Point=area_5.Centroid)  # -> XComponent, YComponent, ZComponent; disabled
ir_sunlight_hours = InFraReDSunlightHoursAnalysis()  # disabled
ir_solar_radiation = InFraReDSolarRadiationAnalysis()  # disabled
pdecon_3 = Deconstruct(Point=area_6.Centroid)  # -> XComponent, YComponent, ZComponent; disabled
txt = Text(ir_auth)  # disabled
bnd_2 = Bounds(Numbers=pdecon_2.ZComponent)  # disabled
bnd_3 = Bounds(Numbers=pdecon_3.ZComponent)  # disabled
names_of_projects = Panel(ir_auth)  # disabled
filter_4 = StreamFilter(Gate=toggle_20, Stream1=rectangle_3.Rectangle)  # disabled
dedomain_2 = DeconstructDomain(Domain=bnd_2)  # -> Start, End; disabled
dedomain_3 = DeconstructDomain(Domain=bnd_3)  # -> Start, End; disabled
panel_66 = Panel("24")  # disabled
panel_67 = Panel("ASYNC-GROUP")  # disabled
equals_2 = Equality(FirstNumber=pdecon_2.ZComponent, SecondNumber=dedomain_2.Start)  # -> Equality, Inequality; disabled
equals_3 = Equality(FirstNumber=pdecon_3.ZComponent, SecondNumber=dedomain_3.Start)  # -> Equality, Inequality; disabled
volume_6 = Volume(Geometry=data_4)  # -> Volume, Centroid; disabled
dispatch = Dispatch(List=debrep.Faces, DispatchPattern=equals_2.Equality)  # -> ListA, ListB; disabled
expression_2 = Expression(x=txt, y=panel_67, Expression="Contains(x,y)")  # disabled
dispatch_2 = Dispatch(List=debrep_2.Faces, DispatchPattern=equals_3.Equality)  # -> ListA, ListB; disabled
area_7 = Area(Geometry=dispatch.ListA)  # -> Area, Centroid; disabled
area_8 = Area(Geometry=dispatch_2.ListA)  # -> Area, Centroid; disabled
pdecon_4 = Deconstruct(Point=volume_6.Centroid)  # -> XComponent, YComponent, ZComponent; disabled
pdecon_5 = Deconstruct(Point=area_7.Centroid)  # -> XComponent, YComponent, ZComponent; disabled
pdecon_6 = Deconstruct(Point=area_8.Centroid)  # -> XComponent, YComponent, ZComponent; disabled
Z_9 = UnitZ(Factor=expr("-x", pdecon_4.ZComponent))  # disabled
crv_2 = Curve([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])  # disabled
Z_10 = UnitZ(Factor=expr("-x", pdecon_5.ZComponent))  # disabled
dispatch_3 = Dispatch(List=ir_auth, DispatchPattern=expression_2)  # -> ListA, ListB; disabled
item_13 = ListItem(List=dispatch_3.ListA, Index=panel_66, Wrap=True)  # disabled
Z_11 = UnitZ(Factor=pdecon_6.ZComponent)  # disabled
data_6 = Data(flatten(Tree({0;0}: [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], {1;0}: [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], {2;0}: [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], {3;0}: [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], {4;0}: [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], {5;0}: [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]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)))  # disabled
move_6 = Move(Geometry=data_2, Motion=Z_10)  # -> Geometry, Transform; disabled
move_7 = Move(Geometry=data_4, Motion=Z_9)  # -> Geometry, Transform; disabled
brep_3 = Brep([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])  # disabled
pt_11 = Point([Point(5.033690881, -10.52038435, 40.01960979), Point(131.7272019, -13.31099032, 50.33266087), Point(134.1608689, 103.0764611, 58.63966846)])  # disabled
move_8 = Move(Geometry=graft(data_4), Motion=Z_11)  # -> Geometry, Transform; disabled
project_2 = Project(Geometry=data_6, Plane=PlaneXY(0, 0, 0))  # -> Geometry, Transform; disabled
txt_2 = Text(dispatch_3.ListA)  # disabled
project_3 = Project(Geometry=pt_11, Plane=PlaneXY(0, 0, 0))  # -> Geometry, Transform; disabled
panel_68 = Panel(txt_2)  # disabled
project_name_2 = Panel(project_name)  # disabled
ir_load_proj = InFraReDLoadProject(ProjectName=project_name_2)  # -> SiteBoundary, ProjectMetadata, Snapshots; disabled
list_of_snapshots_in_project = Panel(ir_load_proj.Snapshots)  # disabled
snapshot_name = Panel("context_1")  # disabled
description = Panel("This is Design Variant  One with...")  # disabled
site_boundary = Data(ir_load_proj.SiteBoundary)  # disabled
panel_69 = Panel("origin")  # disabled
snapshot_name_2 = Panel(snapshot_name)  # disabled
re_run_analysis = Button()  # disabled
ghpython_script = GhPythonScript(name=snapshot_name_2, trigger=re_run_analysis)  # -> n; disabled
# ---------- ghpython_script: Python ----------
__author__ = "DueringS"
__version__ = "2022.08.02"

import rhinoscriptsyntax as rs

n = name
# ---------- end ghpython_script ----------
ir_run = InFraReDRunAnalyses(Name=ghpython_script)  # disabled
bang_2 = ExplodeTree(Data=ir_run)  # -> Branch0, Branch1, Branch2, Branch3; disabled
ir_solar_radiation_2 = InFraReDSolarRadiationAnalysis(Visualisation=bang_2.Branch3)  # disabled
site_boundary_2 = Data(site_boundary)  # disabled
from = Slider(0, range=0..20)  # disabled
to = Slider(1.8, range=0..20)  # disabled

number_slider_23 = Slider(19, range=0..100)  # disabled
number_slider_24 = Slider(270, range=0..1000)  # disabled
number_slider_25 = Slider(19, range=0..100)  # disabled
number_slider_26 = Slider(175, range=0..1000)  # disabled
ir_wind_speed = InFraReDWindSpeedAnalysis(WindSpeed=number_slider_23, WindDirection=number_slider_24)  # disabled
ir_wind_speed_2 = InFraReDWindSpeedAnalysis(WindSpeed=number_slider_25, WindDirection=number_slider_26)  # disabled
merge_2 = Merge(Data1=ir_solar_radiation, Data2=ir_sunlight_hours, Data3=ir_wind_speed, Data4=ir_wind_speed_2)  # disabled

move2pt_7 = MoveToPoint(Geometry=move_6.Geometry, PointA=pt_5, PointB=area_4.Centroid)  # -> Moved, Vector, Transform
move2pt_8 = MoveToPoint(Geometry=move_7.Geometry, PointA=pt_5, PointB=area_4.Centroid)  # -> Moved, Vector, Transform
move2pt_9 = MoveToPoint(Geometry=project_2.Geometry, PointA=pt_5, PointB=area_4.Centroid)  # -> Moved, Vector, Transform
move2pt_10 = MoveToPoint(Geometry=project_3.Geometry, PointA=pt_5, PointB=area_4.Centroid)  # -> Moved, Vector, Transform

buildings_2 = Geometry(flatten([move2pt_8.Moved, move2pt_7.Moved]))  # disabled
street_lines_2 = Geometry(move2pt_9.Moved)  # disabled
poi_2 = Geometry(move2pt_10.Moved)  # disabled

# ---- group: project meta data is saved as a py dictionary
panel_70 = Panel("""projectSouthWestLongitude
projectSouthWestLatitude""")  # disabled
ghpython_script_2 = GhPythonScript(projectMetadata=ir_load_proj.ProjectMetadata, keys=panel_70)  # -> a; disabled
# ---------- ghpython_script_2: Python ----------
__author__ = "DueringS"
__version__ = "2021.12.07"

import rhinoscriptsyntax as rs
import json


data = json.loads(projectMetadata)
if keys == None:
    a = str(data)
else:
    a = data[keys]
# ---------- end ghpython_script_2 ----------

# ----
previewmat_2 = CustomPreviewMaterials(Geometry=move2pt_7.Moved, DiffuseColor=swatch_5)  # disabled
previewmat_3 = CustomPreviewMaterials(Geometry=move2pt_8.Moved, DiffuseColor=swatch_6)  # disabled
previewlw_6 = CustomPreviewLineweights(Geometry=move2pt_9.Moved, Shader=swatch_4, Absolute=False)  # disabled
panel_71 = Panel(bang_2.Branch1)
panel_72 = Panel(bang_2.Branch0)

# ---- group: Read Simulation Result II
ir_read = InFraReDReadAnalyses(AnalysesResults=bang_2.Branch1)  # -> RawData, KPINames, KPIValues; disabled
simulation_result_as_bitmap = Data(ir_read.RawData)  # disabled

# ---- group: Read Simulation Result I
add_kpi_names_of_interest = Panel("...")  # disabled
ir_read_2 = InFraReDReadAnalyses(AnalysesResults=bang_2.Branch0)  # -> RawData, KPINames, KPIValues; disabled
values_of_pre_computed_kpi = Panel(ir_read_2.KPIValues)  # disabled
names_of_pre_computed_kpi = Panel(ir_read_2.KPINames)  # disabled
simulation_result_as_bitmap_2 = Data(ir_read_2.RawData)  # disabled

# ----
ir_create_proj = InFraReDCreateProject(
    ProjectName=project_name,
    ProjectDescription=project_description,
    SiteBoundary=filter_4,
    SouthWestLatitude=panel_63,
    SouthWestLongitude=panel_64,
    AnalysesSettings=merge_2)  # -> SiteBoundary, ProjectMetadata, Snapshots; disabled
explode_5 = Explode(Curve=street_lines_2, Recursive=True)  # -> flatten(Segments), Vertices; disabled
mesh_9 = Mesh(buildings_2)  # disabled
infrared_create_pois = InFraReDCreatePOIs(POIs=poi_2)  # disabled
ir_create_buildings = InFraReDCreateBuildings(Buildings=mesh_9)  # disabled
ir_create_streets = InFraReDCreateStreets(Streets=explode_5.Segments)  # disabled
ir_sync = InFraReDSyncSnapshot(
    Name=snapshot_name,
    Description=description,
    RootSnapshot=panel_69,
    Buildings=ir_create_buildings,
    Streets=ir_create_streets,
    POIs=infrared_create_pois,
    SiteBoundary=site_boundary)  # -> SnapshotMetadata, BuildingsInFraReDSchema, StreetsInFraReDSchema, POIsInFraReDSchema; disabled
merge_3 = Merge(Data1=number_slider_23, Data2=number_slider_25)  # disabled
list_item = ListItem(List=merge_3, Index=0, Wrap=True)  # -> Item, Item1; disabled
flip_bitmap = GhPythonScript(bm=simulation_result_as_bitmap_2)  # -> flipped; disabled
# ---------- flip_bitmap: Python ----------
__author__ = "DueringS"
__version__ = "2021.06.29"

import rhinoscriptsyntax as rs
import System

bmCopy = bm.Clone()
bmCopy.RotateFlip(System.Drawing.RotateFlipType.RotateNoneFlipY)
flipped = bmCopy
# ---------- end flip_bitmap ----------
flip_bitmap_2 = GhPythonScript(bm=simulation_result_as_bitmap)  # -> flipped; disabled; same code as flip_bitmap
wind_speed = Panel(list_item.Item1)  # disabled
previmg = PrevImage(SmartBitmap=flip_bitmap)  # disabled
previmg_2 = PrevImage(SmartBitmap=flip_bitmap_2)  # disabled

wind_speed_2 = Panel(list_item.Item)  # disabled
sample_resolution = Slider(5, range=0..10)  # disabled
cluster = Cluster_3(
    bitmap=flip_bitmap,
    analysisarea=site_boundary_2,
    samplearea=site_boundary_2,
    resolution=sample_resolution,
    wind_speed=wind_speed_2)  # -> pts, wind_speeds; disabled
wind_speed_setting = Data(wind_speed_2)  # disabled

sample_resolution_2 = Slider(5, range=0..10)  # disabled
cluster_2 = Cluster_3(
    bitmap=flip_bitmap_2,
    analysisarea=site_boundary_2,
    samplearea=site_boundary_2,
    resolution=sample_resolution_2,
    wind_speed=wind_speed)  # -> pts, wind_speeds; disabled
wind_speed_setting_2 = Data(wind_speed)  # disabled

values = Data(cluster_2.wind_speeds)  # disabled
values_2 = Data(cluster.wind_speeds)  # disabled
average = Average(Input=values)  # disabled
average_2 = Average(Input=values_2)  # disabled
cluster_3 = Cluster_4(values=values, max=from, min=to)  # disabled
avg_wind_speed_in_sampled_area = Panel(average_2)  # disabled
avg_wind_speed_in_sampled_area_2 = Panel(average)  # disabled
lawson_wind_comfort_sitting_long = Panel(cluster_3)  # disabled

pts = Data(cluster_2.pts)  # disabled
values_3 = Data(cluster_2.wind_speeds)  # disabled
threshold = Slider(1.2, range=0..10)  # disabled
unit_z = UnitZ(Factor=1)  # disabled
move_9 = Move(Geometry=pts, Motion=unit_z)  # -> Geometry, Transform; disabled
larger = LargerThan(FirstNumber=threshold, SecondNumber=values_3)  # -> LargerThan, OrEqualTo; disabled

values_4 = Data(cluster.wind_speeds)  # disabled
pts_2 = Data(cluster.pts)  # disabled
valmax = Data(wind_speed_setting)  # disabled
gradient = Gradient(
    LowerLimit=valmax,
    UpperLimit=0,
    Parameter=values_4,
    stops=[0: RGB(234, 38, 0), 0.25: RGB(234, 126, 0), 0.5: RGB(254, 244, 84), 0.75: RGB(173, 203, 249), 1: RGB(75, 107, 169)])  # disabled
number_slider_27 = Slider(2, range=0..6)  # disabled
cloud_display = CloudDisplay(Points=pts_2, Colours=gradient, Size=number_slider_27, SpriteType=0)  # disabled

cull_2 = CullPattern(List=move_9.Geometry, CullPattern=larger.LargerThan)  # disabled
colour_swatch = ColourSwatch(SwatchColor=RGB(77, 255, 0))  # disabled
number_slider_28 = Slider(3, range=0..6)  # disabled
cloud_display_2 = CloudDisplay(Points=cull_2, Colours=colour_swatch, Size=number_slider_28, SpriteType=0)  # disabled

# ==== cluster Cluster_3
samplearea = ClusterInput()
analysisarea = ClusterInput()
bitmap = ClusterInput()
samplearea_2 = Data(samplearea)
analysisarea_2 = Data(analysisarea)
# note: it  crashes if a sample point is outside the analysis area
bitmap_2 = Data(bitmap)
# with you can sample points in a specific area eg. to compute the KPIs for a local Park specifically
samplearea_3 = Geometry(samplearea_2)
resolution = ClusterInput()
grid_adj_for_direction_of_block = GridAdjForDirectionOfBlock(geometry=samplearea_3, resolution=resolution)  # -> flatten(points)
cluster = Cluster_2(bitmaps=bitmap_2, siteboundary=analysisarea_2, sample_points=flatten(grid_adj_for_direction_of_block))
samplepoints = Data(grid_adj_for_direction_of_block)
colour = Colour(cluster)
# Filter points under buildings (via alpha channel) just pick one of the rgb channels.
split_argb = SplitARGB(Colour=colour)  # -> Alpha, Red, Green, Blue
samplepoints_2 = Data(samplepoints)
larger_than = LargerThan(FirstNumber=split_argb.Alpha, SecondNumber=Slider(0.15, range=0..1))  # -> LargerThan, OrEqualTo
cull_pattern = CullPattern(List=split_argb.Red, CullPattern=larger_than.LargerThan)
wind_speed = ClusterInput()
multiplication = Multiplication(A=cull_pattern, WindSpeed=wind_speed)
cull_pattern_2 = CullPattern(List=samplepoints_2, CullPattern=larger_than.LargerThan)
wind_speeds = ClusterOutput(multiplication)
pts = ClusterOutput(cull_pattern_2)

# ==== cluster Cluster_4
values = ClusterInput()
values_2 = Data(values)
max = ClusterInput()
min = ClusterInput()
smaller_than = SmallerThan(FirstNumber=values_2, SecondNumber=min)  # -> SmallerThan, OrEqualTo
larger_than = LargerThan(FirstNumber=values_2, SecondNumber=max)  # -> LargerThan, OrEqualTo
gate_and = GateAnd(A=smaller_than.OrEqualTo, B=larger_than.OrEqualTo)
cull_pattern = CullPattern(List=values_2, CullPattern=gate_and)
list_length = ListLength(List=cull_pattern)
list_length_2 = ListLength(List=values_2)
division = Division(A=list_length, B=list_length_2)
multiplication = Multiplication(A=division, B="100")
result = Number(expr("round(x,1)", multiplication))
result_2 = ClusterOutput(result)

# ==== cluster GridAdjForDirectionOfBlock
geometry = ClusterInput()
reg_grid = BooleanToggle(True)
project = Project(Geometry=geometry, Plane=PlaneXY(0, 0, 0))  # -> Geometry, Transform
resolution = ClusterInput()
geometry_crv = Geometry(project.Geometry)
bounding_box = BoundingBox(Content=geometry_crv, Plane=PlaneXY(0, 0, 0), UnionBox=False)  # -> Box, Box_2
box_properties = BoxProperties(Box=bounding_box.Box)  # -> Center, Diagonal, Area, Volume, Degeneracy
orthogonal_vectors_datatree_edition = CSharpScript()  # -> A; inputs y: tree of Point3d
# ---------- orthogonal_vectors_datatree_edition: C# ----------
    DataTree<Vector3d> vList = new DataTree<Vector3d>();


    for (int k = 0; k < y.BranchCount; k++)
    {
      for (int i = 0; i < y.Branch(i).Count; i++)
      {

        int xx = 1;
        int yy = 1;

        // ensure x is always positive & that one of x or y is flipt
        if ( y.Branch(k)[i].Y < 0)
        {yy = -1;} else xx = -1;

        Vector3d newVC = new Vector3d(y.Branch(k)[i].Y * yy, y.Branch(k)[i].X * xx, 0);
        vList.Add(newVC, new GH_Path(k));


      }
    }

    A = vList;
# ---------- end orthogonal_vectors_datatree_edition ----------

# ---- group: get direction (ortho. Vector)
smplf_crv = Slider(20, range=0..100)
cluster = Cluster(curves=geometry_crv, tolerance=smplf_crv)  # -> A, ori_vector
ortho_vector = Data(cluster.A)

# ----
vector_xyz = VectorXYZ(XComponent=1, YComponent=0, ZComponent=0)  # -> OrthoV, Length
vector_xyz_2 = VectorXYZ(XComponent=0, YComponent=1, ZComponent=0)  # -> Vector, Length
geometry_2 = Geometry(graft(geometry_crv))
data = Data(box_properties.Diagonal)
stream_filter = StreamFilter(Gate=reg_grid, Stream0=vector_xyz_2.Vector, Stream1=cluster.ori_vector)
stream_filter_2 = StreamFilter(Gate=reg_grid, Stream0=vector_xyz.OrthoV, Stream1=ortho_vector)
point_on_curve = PointOnCurve(geometry_2, parameter=0.5)
multiplication = Multiplication(A=data, B=3)
division = Division(A=multiplication, B=2)
vector_display = VectorDisplay(Anchor=flatten(point_on_curve), Vector=stream_filter)
multiplication_2 = Multiplication(A=stream_filter, B=-1)
boolean_toggle = BooleanToggle(False)

# ---- group: higher resolution to narrow shapes
area = Area(Geometry=geometry_crv, UseTasks=False)  # -> Area, Centroid
length = Length(Curve=geometry_crv)
factor_threshold = Panel("10")
division_2 = Division(A=area.Area, B=length)
ghpython_script = GhPythonScript(x=division_2, y=factor_threshold, z=boolean_toggle)  # -> out, a; inputs x: list, y: Int32, z: list
# ---------- ghpython_script: Python ----------
__author__ = "DueringS"
__version__ = "2018.10.30"

import rhinoscriptsyntax as rs
zz = min(z)
adj = []


#for less compact shapes (eg. very narrow) the resolution is increasesd

for i in range(len(x)):
    if x[i] <= y:
        adj.append(zz)
    else:
        adj.append(z[i])
a = adj
# ---------- end ghpython_script ----------

# ----
line_sdl = LineSDL(Start=box_properties.Center, Direction=stream_filter, Length=multiplication)
amplitude = Amplitude(Vector=multiplication_2, Amplitude=division)
panel = Panel(amplitude)
ortho_vector_2 = Data(simplify(graft(stream_filter_2)))

# ---- group: Lines to shoot rays from
move = Move(Geometry=line_sdl, Motion=amplitude)  # -> Geometry, Transform

# ----
multiplication_3 = Multiplication(A=ortho_vector_2, B=-1)
amplitude_2 = Amplitude(Vector=multiplication_3, Amplitude=simplify(graft(box_properties.Diagonal)))  # -> flatten(Vector)

stream_filter_3 = StreamFilter(Gate=boolean_toggle, Stream0=resolution, Stream1=ghpython_script.a)
length_2 = Data(graft(data))
to_make_sure = Slider(3, range=0..10)
length_3 = Length(Curve=move.Geometry)
move_2 = Move(Geometry=move.Geometry, Motion=amplitude_2)  # -> flatten(Geometry), Transform
data_2 = Data(stream_filter_3)
division_3 = Division(A=length_3, B=data_2)
multiplication_4 = Multiplication(A=length_2, B=to_make_sure)
divide_curve = DivideCurve(Curve=simplify(graft(move_2.Geometry)), Count=simplify(graft(division_3)), Kinks=False, UseTasks=False)  # -> simplify(Points), Tangents, Parameters
multiplication_5 = Multiplication(A=multiplication_4, B=-1)
line_sdl_2 = LineSDL(Start=divide_curve.Points, Direction=ortho_vector_2, Length=multiplication_4)
sort_list = SortList(Keys=boolean_toggle)  # -> Keys, ValuesValuesA
curve_line = CurveLine(Curve=simplify(geometry_2), Line=simplify(line_sdl_2))  # -> simplify(Points), Params, Count
list_length = ListLength(List=sort_list.Keys)
duplicate_data = DuplicateData(Data=resolution, Number=list_length, Order=True)
quick_graph = QuickGraph([sort_list.Keys, resolution, duplicate_data], SortOrder=0)

# ---- group: yay works
sort_points = SortPoints(Points=curve_line.Points)  # -> simplify(Points), Indices

# ---- group: Check datastructure
tree_statistics = TreeStatistics(Tree=sort_points.Points)  # -> Paths, Length, Count
deconstruct_path = DeconstructPath(Branch=tree_statistics.Paths)  # -> simplify(Indices)
list_length_2 = ListLength(List=deconstruct_path)  # -> flatten(Length)
list_item = ListItem(List=list_length_2, Index=0, Wrap=True)
larger_than = LargerThan(FirstNumber=list_item, SecondNumber=1)  # -> LargerThan, OrEqualTo

# ---- group: adjust depth
list_length_3 = ListLength(List=geometry_crv)
ghpython_script_2 = GhPythonScript(x=list_length_3)  # -> a
# ---------- ghpython_script_2: Python ----------
__author__ = "DueringS"
__version__ = "2020.11.27"

import rhinoscriptsyntax as rs

if x == 1:
    a = 0
else:
    a = 1
# ---------- end ghpython_script_2 ----------

# ----
path_mapper = PathMapper(sort_points.Points, source="{A;B}", target="{path_index}")
trim_tree = TrimTree(Tree=sort_points.Points, Depth=ghpython_script_2)
data_3 = Data(path_mapper)
stream_filter_4 = StreamFilter(Gate=larger_than.LargerThan, Stream0=path_mapper, Stream1=trim_tree)
dispatch = Dispatch(List=trim_tree, DispatchPattern=[True, False])  # -> ListA, ListB
line = Line(StartPoint=dispatch.ListA, EndPoint=dispatch.ListB)
length_4 = Length(Curve=line)
division_4 = Division(A=length_4, B=graft(data_2))  # -> simplify(Result)
divide_curve_2 = DivideCurve(Curve=line, Count=division_4, Kinks=False, UseTasks=False)  # -> simplify(Points), Tangents, Parameters
panel_2 = Panel(divide_curve_2.Points)
# hint: deactivate parallel computing .. for a huge speed up
points = ClusterOutput(divide_curve_2.Points)
reg_grid_2 = BooleanToggle(True)

# ==== cluster Cluster_2
bitmaps = ClusterInput()
siteboundary = ClusterInput()
sample_points = ClusterInput()
bitmaps_2 = Data(bitmaps)
siteboundary_2 = Geometry(siteboundary)
sample_points_2 = Data(simplify(sample_points))
ghpython_script = GhPythonScript(bm=bitmaps_2, scale=Slider(1.001, range=0..5))  # -> H, W
# ---------- ghpython_script: Python ----------
__author__ = "DueringS"
__version__ = "2021.06.28"

import rhinoscriptsyntax as rs
H = int(bm.Size.Height / scale)
W = int(bm.Size.Width / scale)
# ---------- end ghpython_script ----------
img_h = Data(flatten(ghpython_script.H))
img_w = Data(flatten(ghpython_script.W))
list_item = ListItem(List=img_w, Index=0, Wrap=True)
list_item_2 = ListItem(List=img_h, Index=0, Wrap=True)
panel = Panel(list_item)
box_corners = BoxCorners(Box=siteboundary_2)  # -> CornerA, CornerB, CornerC, CornerD, CornerE, CornerF, CornerG, CornerH
panel_2 = Panel(list_item_2)
distance = Distance(PointA=box_corners.CornerB, PointB=box_corners.CornerA)
ref = Data(box_corners.CornerD)
distance_2 = Distance(PointA=box_corners.CornerA, PointB=box_corners.CornerD)
deconstruct = Deconstruct(Point=ref)  # -> XComponent, YComponent, ZComponent
deconstruct_2 = Deconstruct(Point=sample_points_2)  # -> XComponent, YComponent, ZComponent
division = Division(A=panel, B=distance)
subtraction = Subtraction(A=deconstruct_2.YComponent, B=deconstruct.YComponent)
subtraction_2 = Subtraction(A=deconstruct_2.XComponent, B=deconstruct.XComponent)
division_2 = Division(A=panel_2, B=distance_2)
multiplication = Multiplication(A=subtraction, B=division_2)
multiplication_2 = Multiplication(A=subtraction_2, B=division)
construct_point = ConstructPoint(XCoordinate=multiplication_2, YCoordinate=expr("x*-1", multiplication), ZCoordinate=0)  # -> simplify(Point)
pixelid = Data(construct_point)
ghpython_script_2 = GhPythonScript(bit=flatten(bitmaps_2), pixID=pixelid)  # -> colTr; inputs bit: list, pixID: list of Point3d
# ---------- ghpython_script_2: Python ----------
__author__ = "sers"
__version__ = "2019.07.18"

import rhinoscriptsyntax as rs
import System.Drawing as sd
import System.Drawing.Bitmap as bt
import System.IO as sio
import base64

import Grasshopper
import Grasshopper.DataTree as tree
import Grasshopper.Kernel.Data.GH_Path as ghpath
import ghpythonlib.parallel as pr
#sd.RotateFlipType(4)
#sd.RotateFlipType(
"""
master_list = []
img = sd.Image.FromFile(imgDir)

# for now no multicore
def process_images(master):
    image = master[1]
    coords = master[2]
    image_id = master[3]
    area_id = master[4]
col = []

"""

colTr = tree[object]()
for im in range(len(bit)):
    #for each image
    #img_tmp = sd.Image.FromFile(imgDirL[im])
    """
    img_tmp = bt(imgDirL[im])
    imgL = img_tmp.Clone()
    img_tmp.Dispose()
    """
    pth = ghpath(im)
    imgL = bit[im]
    for j in range(len(pixID)):
        cc = imgL.GetPixel(pixID[j][0], pixID[j][1])
        #col.append(cc)
        colTr.Add(cc, pth)
# ---------- end ghpython_script_2 ----------
coltr = ClusterOutput(ghpython_script_2)

# ==== cluster Cluster
curves = ClusterInput()
tolerance = ClusterInput()
curves_2 = Data(curves)
tolerance_2 = Data(tolerance)
simplify_curve = SimplifyCurve(Curve=curves_2, Tolerance=tolerance_2, AngleTolerance=tolerance_2)  # -> Curve, Simplified
explode = Explode(Curve=reparameterize(simplify_curve.Curve), Recursive=True)  # -> simplify(Segments), Vertices
evaluate_curve = EvaluateCurve(Curve=reparameterize(explode.Segments), Parameter=0.5)  # -> Point, Tangent, Angle
point_on_curve = PointOnCurve(explode.Segments, parameter=0.5)
length = Length(Curve=explode.Segments)
sort_list = SortList(Keys=length, ValuesValuesA=evaluate_curve.Tangent, ValuesA=point_on_curve)  # -> reverse(Keys), reverse(ValuesValuesA), reverse(ValuesA)
# Vector of longest Segment is chooses
list_item = ListItem(List=sort_list.ValuesValuesA, Index=0, Wrap=True)  # -> flatten(Item)
list_item_2 = ListItem(List=sort_list.ValuesA, Index=0, Wrap=True)  # -> flatten(Item)
orthogonal_vectors = CSharpScript(x=list_item, y=list_item)  # -> A; inputs x: list of Vector3d, y: list of Point3d
# ---------- orthogonal_vectors: C# ----------
    List<Vector3d> vList = new List<Vector3d>();
    
    for (int i = 0; i < x.Count; i++)
    {
    
      int xx = 1;
      int yy = 1;
      
      // ensure x is always positive & that one of x or y is flipt 
      if ( y[i].Y < 0) 
      {yy = -1;} else xx = -1;
      
      Vector3d newVC = new Vector3d(y[i].Y * yy, y[i].X * xx, 0);
      vList.Add(newVC);
    
    }
    
    A = vList;
# ---------- end orthogonal_vectors ----------
A = ClusterOutput(orthogonal_vectors)
ori_vector = ClusterOutput(list_item)
